# Dynamo graph MWP_1.21_DUCT&FITTING_MASTER_ALL DUCT_CME_V1.0.dyn (Dynamo 2.16.4.10216)

# note: All Couple will be 2mm - if "The family is connected in a network and can no longer keep the connectivity. Disconnect the family from the network?"
# either freeze the input or increase the the couple
# note: Create on 13/01/2025 by Conor McEnery
# any question Ring me +353871264178 for Help
# note: THis node can run with out input, this is part of 3 script and this is step 1
# this is the only node that actual edit the ducting. ever thing else is for tag in the schedule
# this is for duct and fiiting so that schedule can be combine for oull calulation sotfware such as elek
# note: check the havc unit are set to percentage as the result are base on this
# note: Try not to use plug, and wrtie a "Python Script" or "code note". Trust me you are better of learn this early
# note: Red is input
# Orange is output
# note: Cretae note in edit tab
# note: Name convention for system should be
# example
# "Mechanical 200mm uPVC DUCT - 20kV SVC  CIRCUIT 10"
# Example
# [Uses-duct Size - Pipe Type] [-] [Volt - Name - Number]
# the "-" sysblom is very important and spaces can be use to list each text
# note: Runtime Estimate
# Allow 1 minute for every 200 element
# Example
# 5000 element
# 5000/200= 25 min Runtime

# group: Actions all input parameter - freeze here to turn off
code_block = CodeBlock { "m_Duct_Section Type"; }
code_block_2 = CodeBlock { "m_Duct_Section Group"; }
length_m = CodeBlock { "Length(m)"; }
m_Radius = CodeBlock { "m_Radius"; }
angle_rad_number = CodeBlock { "Angle Rad_Number"; }
parameter_names = CodeBlock { "m_System Group"; "m_System Name"; "m_System Type"; "m_System Number"; }
duct_id = CodeBlock { "Duct ID"; }
duct_code = CodeBlock { "Duct Code"; }
duct_size = CodeBlock { "OD Duct Size"; }
h_bend_deg = CodeBlock { "H_Bend (Deg)"; }
vh_deg = CodeBlock { "VH Deg"; }
gradient_rad = CodeBlock { "Gradient Rad"; }
m_fitting_qty = CodeBlock { "m_Fitting QTY"; }
# note: All input to be place here and freeze to trouble shot if scrpt stop working.
# Just freeze all node and unfreeze each one untill problem is found
not_sp_straight_out = CodeBlock { "Straight Out"; }
not_sp_straight_in = CodeBlock { "Straight In"; }
duct_size_2 = CodeBlock { "OD Duct Size"; }

# group: DUCT "FITTING" BRANCH
# note: Find all Fitting
string = StringInput("Duct Fittings")
byName = Category.ByName(name=string)
all_elements_of_category = ElementsOfCategory(Category=byName)

# group: System Input
# note: Main System Value
code_block_3 = CodeBlock { "System Name"; "Slope"; }

# group: DUCT BRANCH
# note: Find all Duct
string_2 = StringInput("Ducts")
byName_2 = Category.ByName(name=string_2)
all_elements_of_category_2 = ElementsOfCategory(Category=byName_2)

# group: Input
fitting = Watch(all_elements_of_category)
getParameterValueByName = Element.GetParameterValueByName(element=fitting, parameterName=code_block_3.out0)
DUCT = Watch(all_elements_of_category_2)
getParameterValueByName_2 = Element.GetParameterValueByName(element=DUCT, parameterName=code_block_3.out0)
getParameterValueByName_3 = Element.GetParameterValueByName(element=DUCT, parameterName=code_block_3.out1)

# group: Review
join = List.Join(list0=getParameterValueByName, list1=getParameterValueByName_2)
join_2 = List.Join(list0=fitting, list1=DUCT)

# group: Input
id = Element.Id(element=join_2)
create = List.Create(item0=join, item1=join_2, item2=id)
transpose = List.Transpose(lists=create)
sortByKey = List.SortByKey(list=transpose, keys=id)

# group: To Revit
code_block_4 = CodeBlock { 1; }
getItemAtIndex = List.GetItemAtIndex(index=code_block_4)  # unwired: list

# group: To Revit
code_block_5 = CodeBlock { 0; }
getItemAtIndex_2 = List.GetItemAtIndex(index=code_block_5)  # unwired: list

# group: To Revit
code_block_6 = CodeBlock { 10000; 1; }
map = List.Map(list=sortByKey.sortedList, function=getItemAtIndex)
map_2 = List.Map(list=sortByKey.sortedList, function=getItemAtIndex_2)

# group: m_Duct_Section Group
setParameterByName = Element.SetParameterByName(element=map, parameterName=code_block_2, value=map_2)
watch = Watch(setParameterByName)

# group: Duct lenght
fitting_2 = Watch(fitting)
length = CodeBlock { "Length"; "Bend Arc Length"; }
getParameterValueByName_4 = Element.GetParameterValueByName(element=fitting_2, parameterName=length.out1)
round = Math.Round(number=getParameterValueByName_4)
transpose_2 = List.Transpose(lists=round)
bend_length = Element.SetParameterByName(element=fitting_2, parameterName=length_m, value=transpose_2)
watch_2 = Watch(bend_length)
DUCT_2 = Watch(DUCT)
getParameterValueByName_5 = Element.GetParameterValueByName(element=DUCT_2, parameterName=length.out0)
round_2 = Math.Round(number=getParameterValueByName_5)
transpose_3 = List.Transpose(lists=round_2)
duct_length = Element.SetParameterByName(element=DUCT_2, parameterName=length_m, value=transpose_3)
watch_3 = Watch(duct_length)

# group: Radius_R- "m_Duct_Radius_R"
fitting_3 = Watch(fitting)
watch_4 = Watch(m_Radius)
code_block_7 = CodeBlock { "Center Radius"; }
getParameterValueByName_6 = Element.GetParameterValueByName(element=fitting_3, parameterName=code_block_7)
setParameterByName_2 = Element.SetParameterByName(element=fitting_3, parameterName=watch_4, value=getParameterValueByName_6)
watch_5 = Watch(setParameterByName_2)

FITTING = Watch(fitting)
DUCT_3 = Watch(DUCT)

# group: Review
join_3 = List.Join(list0=FITTING, list1=DUCT_3)
code_block_8 = CodeBlock { "Bend Arc Length"; "Center Radius"; }

# group: Review
getParameterValueByName_7 = Element.GetParameterValueByName(element=join_3, parameterName=code_block_8.out0)
watch_6 = Watch(getParameterValueByName_7)
getParameterValueByName_8 = Element.GetParameterValueByName(element=join_3, parameterName=code_block_8.out1)
watch_7 = Watch(getParameterValueByName_8)
div = watch_6 / watch_7
code_block_9 = CodeBlock { 3; 1; }
mul = div * code_block_9.out1
code_block_10 = CodeBlock(val=mul) { val == null ? 0 : val; }
round_3 = Math.Round(number=code_block_10, digits=code_block_9.out0)

bend_arc_length_radius = Watch(code_block_10)

# group: "Angle (included) Rad" Fitting
setParameterByName_3 = Element.SetParameterByName(element=join_3, parameterName=angle_rad_number, value=bend_arc_length_radius)
watch_8 = Watch(setParameterByName_3)

# group: Name System for sorting
watch_9 = Watch(map_2)
code_block_11 = CodeBlock { " - "; " "; }
split = String.Split(string=watch_9, separator0=code_block_11.out0)
code_block_12 = CodeBlock { 0; 1; 3; }
getItemAtIndex_3 = List.GetItemAtIndex(index=code_block_12.out2)  # unwired: list
map_3 = List.Map(list=split, function=getItemAtIndex_3)
system_type = Watch(map_3)
getItemAtIndex_4 = List.GetItemAtIndex(index=code_block_12.out1)  # unwired: list
map_4 = List.Map(list=split, function=getItemAtIndex_4)
system_name = Watch(map_4)
getItemAtIndex_5 = List.GetItemAtIndex(index=code_block_12.out0)  # unwired: list
map_5 = List.Map(list=split, function=getItemAtIndex_5)
system_group = Watch(map_5)

watch_10 = Watch(map)

# group: Replace Null with 0
code_block_13 = CodeBlock(lst=system_name)
# ---------- code_block_13.designscript (2 lines) ----------
/*Data to be modified.*/
lst: var[]..[];
# ----------------------------------------
code_block_14 = CodeBlock { "0"; }
code_block_15 = CodeBlock(replace=code_block_14)
# ---------- code_block_15.designscript (2 lines) ----------
/*What to replace nulls with.*/
replace: var[]..[];
# ----------------------------------------
python_script = Python(IN[0]=code_block_13, IN[1]=code_block_15)  # CPython3
# ---------- python_script.python (14 lines) ----------
# Made by Gavin Crump
# Free for use
# BIM Guru, www.bimguru.com.au

items = IN[0]
rep = IN[1]

elementlist = list()
for item in items:
	if item is None: 
		item = rep
	elementlist.append(item)
	
OUT = elementlist
# ----------------------------------------

# group: Reverse list order
split_2 = String.Split(string=python_script, separator0=code_block_11.out1)
reverse_list_using_python_node = Python(IN[0]=split_2)  # "Reverse List Using Python Node - get number at end of text"; CPython3
# ---------- reverse_list_using_python_node.python (1 lines) ----------
OUT = map(lambda x: x[::-1], IN[0])
# ----------------------------------------

# group (continued): Name System for sorting
system_number = Watch(reverse_list_using_python_node)

# group: Remove number from system name by negative the number from the text
length_2 = String.Length(string=system_number)
system_number_1 = CodeBlock(SystemNumber=length_2) { SystemNumber *-1; }
remove = String.Remove(string=python_script, startIndex=system_number_1, count=length_2)

# group: To Revit
code_block_16 = CodeBlock { 0; }
getItemAtIndex_6 = List.GetItemAtIndex(index=code_block_16)  # unwired: list
map_6 = List.Map(list=system_number, function=getItemAtIndex_6)
map_7 = List.Map(list=split_2, function=getItemAtIndex_6)

# group: Outputs
watch_11 = Watch(map_6)
watch_12 = Watch(map_7)

# group: Replace Null with "0"
code_block_17 = CodeBlock(val1=remove, val2=system_group, val3=watch_11, val4=watch_12) { val1 == null ? "0" : val1; val2 == null ? "0" : val2; val3 == null ? "0" : val3; val4 == null ? "0" : val4; }

# group: System Name- pick 0 in the list
watch_13 = Watch(code_block_17.out0)
code_block_18 = CodeBlock { 0; }
getItemAtIndex_7 = List.GetItemAtIndex(index=code_block_18)  # unwired: list
map_8 = List.Map(list=watch_13, function=getItemAtIndex_7)

# group: Naming for tagging and sorting
system_group_2 = Element.SetParameterByName(element=watch_10, parameterName=parameter_names.out0, value=code_block_17.out1)
watch_14 = Watch(system_group_2)
system_number_2 = Element.SetParameterByName(element=watch_10, parameterName=parameter_names.out3, value=code_block_17.out2)
watch_15 = Watch(system_number_2)
system_name_2 = Element.SetParameterByName(element=watch_10, parameterName=parameter_names.out1, value=map_8)
watch_16 = Watch(system_name_2)
system_type_2 = Element.SetParameterByName(element=watch_10, parameterName=parameter_names.out2, value=code_block_17.out3)
watch_17 = Watch(system_type_2)

# group: Review
fit = Watch(all_elements_of_category)
duct = Watch(all_elements_of_category_2)

# group: Review
fitting_4 = Watch(fit)
DUCT_4 = Watch(duct)

# group: OD Duct Size
code_block_19 = CodeBlock { "Fitting - Diameter"; }
fitting_5 = Element.GetParameterValueByName(element=fitting_4, parameterName=code_block_19)
setParameterByName_4 = Element.SetParameterByName(element=fitting_4, parameterName=duct_size, value=fitting_5)
watch_18 = Watch(setParameterByName_4)
code_block_20 = CodeBlock { "Diameter"; "Hydraulic Diameter"; }
diameter = Element.GetParameterValueByName(element=DUCT_4, parameterName=code_block_20.out1)
setParameterByName_5 = Element.SetParameterByName(element=DUCT_4, parameterName=duct_size_2, value=diameter)
watch_19 = Watch(setParameterByName_5)

FITTIing = Watch(fitting_5)

# group: To Revit
n250 = CodeBlock { 250; OD250=227.3; "SDR 22"; }  # "250"
n200 = CodeBlock { 200; OD200=187.6; "SDR 33"; }  # "200"
n160 = CodeBlock { 160; OD160=150.2; "SDR 33"; }  # "160"
n125 = CodeBlock { 125; OD125=117.2; "SDR 33"; }  # "125"
n100 = CodeBlock { 100; OD100=94.9; ""; }  # "100"
n50 = CodeBlock { 50; OD50=45; ""; }  # "50"
n0 = CodeBlock { 0; OD0=0; ""; }  # "0"

# group: Fit
if_statment = CodeBlock(InDucts=FITTIing, ductSize=n250.out0, Results=n250.OD250) { InDucts==ductSize?Results:0; }
if_statment_2 = CodeBlock(InDucts=FITTIing, ductSize=n200.out0, Results=n200.OD200) { InDucts==ductSize?Results:0; }
if_statment_3 = CodeBlock(InDucts=FITTIing, ductSize=n160.out0, Results=n160.OD160) { InDucts==ductSize?Results:0; }
if_statment_4 = CodeBlock(InDucts=FITTIing, ductSize=n125.out0, Results=n125.OD125) { InDucts==ductSize?Results:0; }
if_statment_5 = CodeBlock(InDucts=FITTIing, ductSize=n100.out0, Results=n100.OD100) { InDucts==ductSize?Results:0; }
if_statment_6 = CodeBlock(InDucts=FITTIing, ductSize=n50.out0, Results=n50.OD50) { InDucts==ductSize?Results:0; }
if_statment_7 = CodeBlock(InDucts=FITTIing, ductSize=n0.out0, Results=n0.OD0) { InDucts==ductSize?Results:0; }
code_block_21 = CodeBlock(a=if_statment, b=if_statment_2, c=if_statment_3, d=if_statment_4, e=if_statment_5, f=if_statment_6, g=if_statment_7) { a+b+c+d+e+f+g; }

# group: Fit
n250_2 = CodeBlock(InDucts=FITTIing, ductSize=n250.out0, Results=n250.out2) { InDucts==ductSize?Results:""; }  # "250"
n200_2 = CodeBlock(InDucts=FITTIing, ductSize=n200.out0, Results=n200.out2) { InDucts==ductSize?Results:""; }  # "200"
n160_2 = CodeBlock(InDucts=FITTIing, ductSize=n160.out0, Results=n160.out2) { InDucts==ductSize?Results:""; }  # "160"
if_statment125 = CodeBlock(InDucts=FITTIing, ductSize=n125.out0, Results=n125.out2) { InDucts==ductSize?Results:""; }
n100_2 = CodeBlock(InDucts=FITTIing, ductSize=n100.out0, Results=n100.out2) { InDucts==ductSize?Results:"0"; }  # "100"
if_50 = CodeBlock(InDucts=FITTIing, ductSize=n50.out0, Results=n50.out2) { InDucts==ductSize?Results:""; }
n0_2 = CodeBlock(InDucts=FITTIing, ductSize=n0.out0, Results=n0.out2) { InDucts==ductSize?Results:""; }  # "0"
code_block_22 = CodeBlock(a=n250_2, b=n200_2, c=n160_2, d=if_statment125, e=n100_2, f=if_50, g=n0_2) { a+b+c+d+e+f+g; }

watch_20 = Watch(fitting)

# group: Bend Arc Length L
watch_21 = Watch(watch_20)
bend_arc_length = CodeBlock { "Bend Arc Length"; }
getParameterValueByName_9 = Element.GetParameterValueByName(element=watch_21, parameterName=bend_arc_length)
round_4 = Math.Round(number=getParameterValueByName_9)
transpose_4 = List.Transpose(lists=round_4)
setParameterByName_6 = Element.SetParameterByName(element=watch_21, parameterName=length_m, value=transpose_4)
watch_22 = Watch(setParameterByName_6)

# group: Review
fitting_6 = Watch(fitting)
duct_2 = Watch(DUCT)

# group: Bend Angle_m_Duct_Angle_Horizontal Bend"---------------------- H_Bend (Deg)-------------------- fitting
watch_23 = Watch(h_bend_deg)
code_block_23 = CodeBlock { "Fitting Angle"; }
getParameterValueByName_10 = Element.GetParameterValueByName(element=fitting_6, parameterName=code_block_23)
code_block_24 = CodeBlock(val=getParameterValueByName_10) { val == "" ? 0 : val; }
code_block_25 = CodeBlock { 2; }
round_5 = Math.Round(number=code_block_24, digits=code_block_25)
setParameterByName_7 = Element.SetParameterByName(element=watch_20, parameterName=watch_23, value=round_5)
watch_24 = Watch(setParameterByName_7)

# group: Precent Slope to Rad
DUCT_5 = Watch(getParameterValueByName_3)
code_block_26 = CodeBlock { (3.141592654*2); 100; false; }
div_2 = code_block_26.out1 / DUCT_5
div_3 = code_block_26.out0 / div_2
null_to_zero = CodeBlock(val=div_3) { val == null ? 0 : val; }
code_block_27 = CodeBlock { 3; }
round_6 = Math.Round(number=null_to_zero, digits=code_block_27)

# group: Slope to Tan
code_block_28 = CodeBlock { 100; }
div_4 = DUCT_5 / code_block_28
code_block_29 = CodeBlock(val=div_4) { val == null ? 0 : val; }
code_block_30 = CodeBlock(val=code_block_29) { val == "" ? 0 : val; }
atan = Math.Atan(ratio=code_block_30)
round_7 = Math.Round(number=atan)

# group: % Slope to Degree - VH Deg
vh_deg_2 = Element.SetParameterByName(element=DUCT, parameterName=vh_deg, value=round_7)
watch_25 = Watch(vh_deg_2)

# group: "Gradient Rad" DUCT
gradient_rad_2 = Element.SetParameterByName(element=DUCT, parameterName=gradient_rad, value=round_6)
watch_26 = Watch(gradient_rad_2)

# group: m_Fitting_Duct QTY
join_4 = List.Join(list0=watch_20, list1=duct_2)
code_block_31 = CodeBlock { 1; }
# note: This is a number value so that it can be use to multiply maths
# Example fromula in Schedules
# Length*Length= Wrong
# Length*Number= Correct
setParameterByName_8 = Element.SetParameterByName(element=join_4, parameterName=m_fitting_qty, value=code_block_31)

# group: Duct lenghtFix Duct Fitting Coupleing " "Say 2mm in and out" That 4mm out for each fitting
# note: This could cause long run time and warning message in  revit, change the value or freeze
# "Do not Disconnent the network"
watch_27 = Watch(fitting)
code_block_32 = CodeBlock { 2; }
round_8 = Math.Round(number=code_block_32)
setParameterByName_9 = Element.SetParameterByName(element=watch_27, parameterName=not_sp_straight_out, value=round_8)
watch_28 = Watch(setParameterByName_9)
setParameterByName_10 = Element.SetParameterByName(element=watch_27, parameterName=not_sp_straight_in, value=round_8)
watch_29 = Watch(setParameterByName_10)

DUCT_6 = Watch(diameter)

# group: DUCT
n250_3 = CodeBlock(InDucts=DUCT_6, ductSize=n250.out0, Results=n250.out2) { InDucts==ductSize?Results:""; }  # "250"
n200_3 = CodeBlock(InDucts=DUCT_6, ductSize=n200.out0, Results=n200.out2) { InDucts==ductSize?Results:""; }  # "200"
n160_3 = CodeBlock(InDucts=DUCT_6, ductSize=n160.out0, Results=n160.out2) { InDucts==ductSize?Results:""; }  # "160"
if_statment125_2 = CodeBlock(InDucts=DUCT_6, ductSize=n125.out0, Results=n125.out2) { InDucts==ductSize?Results:""; }
n100_3 = CodeBlock(InDucts=DUCT_6, ductSize=n100.out0, Results=n100.out2) { InDucts==ductSize?Results:""; }  # "100"
if_50_2 = CodeBlock(InDucts=DUCT_6, ductSize=n50.out0, Results=n50.out2) { InDucts==ductSize?Results:""; }
n0_3 = CodeBlock(InDucts=DUCT_6, ductSize=n0.out0, Results=n0.out2) { InDucts==ductSize?Results:""; }  # "0"
code_block_33 = CodeBlock(a=n250_3, b=n200_3, c=n160_3, d=if_statment125_2, e=n100_3, f=if_50_2, g=n0_3) { a+b+c+d+e+f+g; }

# group: "Duct Code"
setParameterByName_11 = Element.SetParameterByName(element=fitting_4, parameterName=duct_code, value=code_block_22)
watch_30 = Watch(setParameterByName_11)
setParameterByName_12 = Element.SetParameterByName(element=DUCT_4, parameterName=duct_code, value=code_block_33)
watch_31 = Watch(setParameterByName_12)

# group: DUCT
if_statment_8 = CodeBlock(InDucts=DUCT_6, ductSize=n250.out0, Results=n250.OD250) { InDucts==ductSize?Results:0; }
if_statment_9 = CodeBlock(InDucts=DUCT_6, ductSize=n200.out0, Results=n200.OD200) { InDucts==ductSize?Results:0; }
if_statment_10 = CodeBlock(InDucts=DUCT_6, ductSize=n160.out0, Results=n160.OD160) { InDucts==ductSize?Results:0; }
if_statment_11 = CodeBlock(InDucts=DUCT_6, ductSize=n125.out0, Results=n125.OD125) { InDucts==ductSize?Results:0; }
if_statment_12 = CodeBlock(InDucts=DUCT_6, ductSize=n100.out0, Results=n100.OD100) { InDucts==ductSize?Results:0; }
if_statment_13 = CodeBlock(InDucts=DUCT_6, ductSize=n50.out0, Results=n50.OD50) { InDucts==ductSize?Results:0; }
if_statment_14 = CodeBlock(InDucts=DUCT_6, ductSize=n0.out0, Results=n0.OD0) { InDucts==ductSize?Results:0; }
code_block_34 = CodeBlock(a=if_statment_8, b=if_statment_9, c=if_statment_10, d=if_statment_11, e=if_statment_12, f=if_statment_13, g=if_statment_14) { a+b+c+d+e+f+g; }

# group: Duct ID
fitting_7 = Element.SetParameterByName(element=fitting_4, parameterName=duct_id, value=code_block_21)
watch_32 = Watch(fitting_7)
setParameterByName_13 = Element.SetParameterByName(element=DUCT_4, parameterName=duct_id, value=code_block_34)
watch_33 = Watch(setParameterByName_13)
