# Dynamo graph MWP_2.0 DUCT&FITTING_SELECT RUN BY DIRECT SEQUENCE_CME_V1.0.dyn (Dynamo 2.16.4.10216)

# group: Note
# note: Oeder the network for pull cal
# note: Cumulative result
# note: Total length
# note: Create on 13/01/2025 by Conor McEnery
# any question Ring me +353871264178 for Help

# group: SELECT ORDER, Best to do this in a Unlock 3D View - -base on Springs app
code_block = CodeBlock { refresh:bool = true; }
python_script = Python(IN[0]=code_block)  # CPython3
# ---------- python_script.python (38 lines) ----------
#ConorMcenery
# nspired, dimitar.ven@gmail.com

#inspired by Troy Gates https://forums.autodesk.com/t5/revit-api/revit-api-selected-element-set-order/td-p/5597203

import clr

clr.AddReference("RevitAPIUI")
from  Autodesk.Revit.UI import *

clr.AddReference("RevitServices")
import RevitServices
from RevitServices.Persistence import DocumentManager
doc = DocumentManager.Instance.CurrentDBDocument
uidoc=DocumentManager.Instance.CurrentUIApplication.ActiveUIDocument

clr.AddReference("RevitNodes")
import Revit
clr.ImportExtensions(Revit.Elements)

def output1(l1):
	if len(l1) == 1: return l1[0]
	else: return l1

sel1 = uidoc.Selection
obt1 = Selection.ObjectType.Element
msg1 = 'MWP--Read This--Pick elements in the desired order, hit ESC to stop picking'
out1 = []

flag = True
TaskDialog.Show("Spring Nodes", msg1)
while flag:
	try:
		el1 = doc.GetElement(sel1.PickObject(obt1, msg1).ElementId)
		out1.append(el1.ToDSType(True))
	except : flag = False

OUT = output1(out1)
# ----------------------------------------
code_block_2 = CodeBlock(elements=python_script) { elements; }

watch = Watch(code_block_2)

# group: Review
number = DoubleInput(1)  # graph input
count = List.Count(list=watch)
code_block_3 = CodeBlock(num=number, x=count) { num..x+num-1; }
string_from_object = FromObject(object=code_block_3)
lastItem = List.LastItem(list=string_from_object)

# group: Input
code_block_4 = CodeBlock { "Number Sequence"; }
code_block_5 = CodeBlock { "System Name"; }
code_block_6 = CodeBlock { "Cumulative Length(m)"; }
code_block_7 = CodeBlock { "m_STRAIGHT SEGMENT"; "m_BEND ARC LENGTH"; "m_DUCTING RUNS"; "Mark"; }
code_block_8 = CodeBlock { "Total Length of Run"; }
code_block_9 = CodeBlock { "Duct Count"; }

# group: Review
getParameterValueByName = Element.GetParameterValueByName(element=watch, parameterName=code_block_5, lacing=Longest)

# group: Sort number at end
watch_2 = Watch(getParameterValueByName)
code_block_10 = CodeBlock { " "; }
split = String.Split(string=watch_2, separator0=code_block_10)
reverse_list_using_python_node = Python(IN[0]=split)  # "Reverse List Using Python Node - get number at end of text"; CPython3
# ---------- reverse_list_using_python_node.python (1 lines) ----------
OUT = map(lambda x: x[::-1], IN[0])
# ----------------------------------------
transpose = List.Transpose(lists=reverse_list_using_python_node)
code_block_11 = CodeBlock { 0; }
getItemAtIndex = List.GetItemAtIndex(list=transpose, index=code_block_11)
watch_3 = Watch(getItemAtIndex)

# group: Combine
code_block_12 = CodeBlock(a=watch_3, b=string_from_object) { a+"_"+b; }

number_check = Watch(code_block_12)

# group: m_Duct_Number Sequence
setParameterByName = Element.SetParameterByName(element=watch, parameterName=code_block_4, value=number_check)
watch_4 = Watch(setParameterByName)

# group: Paramter used
code_block_13 = CodeBlock { "System Name"; "Bend Arc Length"; "Number Sequence"; "Radius"; "Section Type"; "Length"; "Cumulative Length(m)"; }

# group: Section Type
getParameterValueByName_2 = Element.GetParameterValueByName(element=watch, parameterName=code_block_13.out4)
watch_5 = Watch(getParameterValueByName_2)

# group: Number Sequence_Fitting Duct_Duct
getParameterValueByName_3 = Element.GetParameterValueByName(element=watch, parameterName=code_block_13.out2)
watch_6 = Watch(getParameterValueByName_3)
getParameterValueByName_4 = Element.GetParameterValueByName(element=watch, parameterName=code_block_13.out2)
watch_7 = Watch(getParameterValueByName_4)

# group: Create list to sort ID
list_create = List.Create(item0=watch_7)
watch_8 = Watch(list_create)

# group: Length (m)
bend_arc_length = Element.GetParameterValueByName(element=watch, parameterName=code_block_13.out1)
watch_9 = Watch(bend_arc_length)
duct_length = Element.GetParameterValueByName(element=watch, parameterName=code_block_13.out5)
watch_10 = Watch(duct_length)

# group: Cumulative sum
add = watch_9 + watch_10
list_create_2 = List.Create(item0=add)
toNumber = String.ToNumber(string=list_create_2)
python_script_cumulative_sum = Python(IN[0]=toNumber)  # CPython3
# ---------- python_script_cumulative_sum.python (1 lines) ----------
OUT = [[sum(i[:j]) for j in range(1,len(i)+1)] for i in IN[0]]
# ----------------------------------------
watch_11 = Watch(python_script_cumulative_sum)

# group: Pick List
code_block_14 = CodeBlock { 1; }
getItemAtIndex_2 = List.GetItemAtIndex(index=code_block_14)  # unwired: list

# group: Return list
join = List.Join(list0=watch_8, list1=watch_11)
transpose_2 = List.Transpose(lists=join)
map = List.Map(list=transpose_2, function=getItemAtIndex_2)

# group: add sum to "Cumulative Length(m)
setParameterByName_2 = Element.SetParameterByName(element=watch, parameterName=code_block_6, value=map)
watch_12 = Watch(setParameterByName_2)

# group: Total Fitting
code_block_15 = CodeBlock(val=watch_9) { val == null ? 0 : val; }
code_block_16 = CodeBlock(val=code_block_15) { val == "" ? 0 : val; }
fitting_sum = Math.Sum(values=code_block_16)
watch_13 = Watch(fitting_sum)

# group: To Revit
transpose_3 = List.Transpose(lists=getParameterValueByName)
code_block_17 = CodeBlock { 0; }
getItemAtIndex_3 = List.GetItemAtIndex(list=transpose_3, index=code_block_17)

# group: Total Duct
code_block_18 = CodeBlock(val=watch_10) { val == null ? 0 : val; }
code_block_19 = CodeBlock(val=code_block_18) { val == "" ? 0 : val; }
duct_sum = Math.Sum(values=code_block_19)
watch_14 = Watch(duct_sum)

# group: Not in uses
setParameterByName_3 = Element.SetParameterByName()  # unwired: element, parameterName, value
watch_15 = Watch(setParameterByName_3)
setParameterByName_4 = Element.SetParameterByName(parameterName=code_block_7.out1, value=watch_13)  # unwired: element
watch_16 = Watch(setParameterByName_4)
setParameterByName_5 = Element.SetParameterByName(parameterName=code_block_7.out0, value=watch_14)  # unwired: element
watch_17 = Watch(setParameterByName_5)

# group: Total Length of Run
sum = Math.Sum(values=map)
setParameterByName_6 = Element.SetParameterByName(element=watch, parameterName=code_block_8, value=sum)
watch_18 = Watch(setParameterByName_6)

# group: Duct Count by Group
count_2 = List.Count(list=map)
round = Math.Round(number=count_2)
setParameterByName_7 = Element.SetParameterByName(element=watch, parameterName=code_block_9, value=round)
