# Dynamo graph MWP_3.0 DUCT&FITTING_SECTION_TYPE_SCHEDULES_CME_V1.0.dyn (Dynamo 2.16.4.10216)

# group: Note
# note: This script add infomation that can be scedules for the pull calc base on the section type
# Once you manual selected the scetion Type( Yes/no) parameter for both Duct and Fitting.
# note: Create on 13/01/2025 by Conor McEnery
# any question Ring me +353871264178 for Help

# group: DUCT BRANCH
string = StringInput("Ducts")
byName = Category.ByName(name=string)
all_elements_of_category = ElementsOfCategory(Category=byName)

# group: Result text output
shared_parameters = CodeBlock { "Section Type"; }
code_block = CodeBlock()
# ---------- code_block.designscript (9 lines) ----------
"Straight or horizontal";
"Slope Up";
"Slope Down";
"Concave Downward Bend";
"Concave Upward Bend";
"Convex Downward Bend";
"Convex Upward Bend";
"Horizontal Bend";
"";
# ----------------------------------------

# group: Find Parameter" add here for new.
code_block_2 = CodeBlock()
# ---------- code_block_2.designscript (8 lines) ----------
"m_Duct_Yes/no_Straight";
"m_Duct_Yes/no_Slope Up";
"m_Duct_Yes/no_Slope Down";
"m_Duct_Yes/no_Concave Downward Bend";
"m_Duct_Yes/no_Concave Upward Bend";
"m_Duct_Yes/no_Convex Downward Bend";
"m_Duct_Yes/no_Convex Upward Bend";
"m_Duct_Yes/no_Horizontal Bend";
# ----------------------------------------

# group: To Revit
getParameterValueByName = Element.GetParameterValueByName(element=all_elements_of_category, parameterName=code_block_2.out0)
getParameterValueByName_2 = Element.GetParameterValueByName(element=all_elements_of_category, parameterName=code_block_2.out1)
getParameterValueByName_3 = Element.GetParameterValueByName(element=all_elements_of_category, parameterName=code_block_2.out2)

# group: Input
straight = RefactoredIf(test=getParameterValueByName, true=code_block.out0, false=code_block.out8)
slope_up = RefactoredIf(test=getParameterValueByName_2, true=code_block.out1, false=code_block.out8)
slope_down = RefactoredIf(test=getParameterValueByName_3, true=code_block.out2, false=code_block.out8)

# group: Combine DUCT BRANCH
code_block_3 = CodeBlock(Straight=straight, SlopeUp=slope_up, SlopeDown=slope_down) { Straight+SlopeUp+SlopeDown; }

# group: ID_Outputs
setParameterByName = Element.SetParameterByName(element=all_elements_of_category, parameterName=shared_parameters, value=code_block_3)
watch = Watch(setParameterByName)

# group: DUCT FITTING BRANCH
string_2 = StringInput("Duct Fittings")
byName_2 = Category.ByName(name=string_2)
all_elements_of_category_2 = ElementsOfCategory(Category=byName_2)

# group: To Revit
getParameterValueByName_4 = Element.GetParameterValueByName(element=all_elements_of_category_2, parameterName=code_block_2.out3)
getParameterValueByName_5 = Element.GetParameterValueByName(element=all_elements_of_category_2, parameterName=code_block_2.out4)
getParameterValueByName_6 = Element.GetParameterValueByName(element=all_elements_of_category_2, parameterName=code_block_2.out5)
getParameterValueByName_7 = Element.GetParameterValueByName(element=all_elements_of_category_2, parameterName=code_block_2.out6)
getParameterValueByName_8 = Element.GetParameterValueByName(element=all_elements_of_category_2, parameterName=code_block_2.out7)

# group: Review
concave_downward_bend = RefactoredIf(test=getParameterValueByName_4, true=code_block.out3, false=code_block.out8)
concave_upward_bend = RefactoredIf(test=getParameterValueByName_5, true=code_block.out4, false=code_block.out8)
convex_downward_bend = RefactoredIf(test=getParameterValueByName_6, true=code_block.out5, false=code_block.out8)
convex_upward_bend = RefactoredIf(test=getParameterValueByName_7, true=code_block.out6, false=code_block.out8)
horizontal_bend = RefactoredIf(test=getParameterValueByName_8, true=code_block.out7, false=code_block.out8)

# group: Combine DUCT FITTING
code_block_4 = CodeBlock(ConcaveDown=concave_downward_bend, ConcaveUpward=concave_upward_bend, ConvexDownward=convex_downward_bend, ConvexUpward=convex_upward_bend, HorizontalBend=horizontal_bend) { ConcaveDown+ConcaveUpward+ConvexDownward+ConvexUpward+HorizontalBend; }

# group: DUCT FITTING BRANCH
setParameterByName_2 = Element.SetParameterByName(element=all_elements_of_category_2, parameterName=shared_parameters, value=code_block_4)
watch_2 = Watch(setParameterByName_2)
