# Dynamo graph MWP_Step2.22- Ducts-Pullcal_IEEE-1185-2019_Slope_unit_Precentage.dyn "MWP_Step2.22 DUCT&FITTING_-Pullcal tb194_35Item_unit_Percent" (Dynamo 2.16.4.10216)

# note: All Couple will be 2mm - if "The family is connected in a network and can no longer keep the connectivity. Disconnect the family from the network?"
# either freeze the input or increase the the couple
# note: Create on 13/01/2025 by Conor McEnery
# any question Ring me +353871264178 for Help
# note: THis node can run with out input, this is part of 3 script and this is step 1
# this is the only node that actual edit the ducting. ever thing else is for tag in the schedule
# this is for duct and fiiting so that schedule can be combine for oull calulation sotfware such as elek
# note: check the havc unit are set to percentage as the result are base on this
# note: Try not to use plug, and wrtie a "Python Script" or "code note". Trust me you are better of learn this early
# note: Red is input
# Orange is output
# note: Cretae note in edit tab
# note: Name convention for system should be
# example
# "Mechanical 200mm uPVC DUCT - 20kV SVC  CIRCUIT 10"
# Example
# [Uses-duct Size - Pipe Type] [-] [Volt - Name - Number]
# the "-" sysblom is very important and spaces can be use to list each text
# note: Runtime Estimate
# Allow 1 minute for every 200 element
# Example
# 5000 element
# 5000/200= 25 min Runtime
# note: Line Slope up and down are in dregree only -not radiain
# note: If you see “null” or “NAN”
# Cause you pick Slope up or Slope down, but it actual a straight
# Solution
# Check Section Type of DUCT

# group: Note
# note: Oeder the network for pull cal
# note: Cumulative result
# note: Total length
# note: Create on 13/01/2025 by Conor McEnery
# any question Ring me +353871264178 for Help

# group: SELECT ORDER, Best to do this in a Unlock 3D View - -base on Springs app
refresh_1 = CodeBlock { refresh:bool = true; }
python_script_after_section_type = Python(IN[0]=refresh_1)  # CPython3
# ---------- python_script_after_section_type.python (36 lines) ----------
#ConorMcenery_MWP_12/02/2025 - PUll Cal IEEE-1185-2019
#inspired by Troy Gates https://forums.autodesk.com/t5/revit-api/revit-api-selected-element-set-order/td-p/5597203

import clr

clr.AddReference("RevitAPIUI")
from  Autodesk.Revit.UI import *

clr.AddReference("RevitServices")
import RevitServices
from RevitServices.Persistence import DocumentManager
doc = DocumentManager.Instance.CurrentDBDocument
uidoc=DocumentManager.Instance.CurrentUIApplication.ActiveUIDocument

clr.AddReference("RevitNodes")
import Revit
clr.ImportExtensions(Revit.Elements)

def output1(l1):
	if len(l1) == 1: return l1[0]
	else: return l1

sel1 = uidoc.Selection
obt1 = Selection.ObjectType.Element
msg1 = 'MWP--Read This--Check Slope Unit in Percentage %-- Pick elements in the desired order, hit ESC to stop picking'
out1 = []

flag = True
TaskDialog.Show("MWP_Pull Cal_IEEE-1185-2019", msg1)
while flag:
	try:
		el1 = doc.GetElement(sel1.PickObject(obt1, msg1).ElementId)
		out1.append(el1.ToDSType(True))
	except : flag = False

OUT = output1(out1)
# ----------------------------------------
elements = CodeBlock(elements=python_script_after_section_type) { elements; }
section_type = CodeBlock { "Section Type"; }

# group: SECTION_TYPE_SCHEDULES
watch = Watch(elements)
code_block = CodeBlock(Section_Type=section_type) { Section_Type: string; }
code_block_2 = CodeBlock()
# ---------- code_block_2.designscript (8 lines) ----------
"m_Duct_Yes/no_Straight";
"m_Duct_Yes/no_Slope Up";
"m_Duct_Yes/no_Slope Down";
"m_Duct_Yes/no_Concave Downward Bend";
"m_Duct_Yes/no_Concave Upward Bend";
"m_Duct_Yes/no_Convex Downward Bend";
"m_Duct_Yes/no_Convex Upward Bend";
"m_Duct_Yes/no_Horizontal Bend";
# ----------------------------------------
get_selected_straight = Element.GetParameterValueByName(element=watch, parameterName=code_block_2.out0)
code_block_3 = CodeBlock()
# ---------- code_block_3.designscript (9 lines) ----------
"Straight or horizontal";
"Slope Up";
"Slope Down";
"Concave Downward Bend";
"Concave Upward Bend";
"Convex Downward Bend";
"Convex Upward Bend";
"Horizontal Bend";
"";
# ----------------------------------------
straight = RefactoredIf(test=get_selected_straight, true=code_block_3.out0, false=code_block_3.out8)
get_selected_slope_up = Element.GetParameterValueByName(element=watch, parameterName=code_block_2.out1)
slope_up = RefactoredIf(test=get_selected_slope_up, true=code_block_3.out1, false=code_block_3.out8)
get_selected_slope_down = Element.GetParameterValueByName(element=watch, parameterName=code_block_2.out2)
slope_down = RefactoredIf(test=get_selected_slope_down, true=code_block_3.out2, false=code_block_3.out8)
get_selected_horizontal_bend = Element.GetParameterValueByName(element=watch, parameterName=code_block_2.out7)
horizontal_bend = RefactoredIf(test=get_selected_horizontal_bend, true=code_block_3.out7, false=code_block_3.out8)
get_selected_concave_downward = Element.GetParameterValueByName(element=watch, parameterName=code_block_2.out3)  # "Get selected - Concave Downward Bend"
concave_downward_bend = RefactoredIf(test=get_selected_concave_downward, true=code_block_3.out3, false=code_block_3.out8)
get_selected_concave_upward_bend = Element.GetParameterValueByName(element=watch, parameterName=code_block_2.out4)
concave_upward_bend = RefactoredIf(test=get_selected_concave_upward_bend, true=code_block_3.out4, false=code_block_3.out8)
get_selected_cconvex_downward = Element.GetParameterValueByName(element=watch, parameterName=code_block_2.out5)  # "Get selected - CConvex Downward Bend"
convex_downward_bend = RefactoredIf(test=get_selected_cconvex_downward, true=code_block_3.out5, false=code_block_3.out8)
get_selected_convex_upward_bend = Element.GetParameterValueByName(element=watch, parameterName=code_block_2.out6)
convex_upward_bend = RefactoredIf(test=get_selected_convex_upward_bend, true=code_block_3.out6, false=code_block_3.out8)
code_block_4 = CodeBlock(Straight=straight, SlopeUp=slope_up, SlopeDown=slope_down, HorizontalBend=horizontal_bend, ConcaveDown=concave_downward_bend, ConcaveUpward=concave_upward_bend, ConvexDownward=convex_downward_bend, ConvexUpward=convex_upward_bend) { Straight+SlopeUp+SlopeDown+HorizontalBend+ConcaveDown+ConcaveUpward+ConvexDownward+ConvexUpward; }
setParameterByName = Element.SetParameterByName(element=watch, parameterName=code_block, value=code_block_4)
code_block_5 = CodeBlock(Element_Out=setParameterByName) { Element_Out; }

watch_2 = Watch(code_block_5)

# group: Input
code_block_6 = CodeBlock { "Number Sequence"; }
code_block_7 = CodeBlock { "System Name"; }
code_block_8 = CodeBlock { "Cumulative Length(m)"; }
code_block_9 = CodeBlock { "m_STRAIGHT SEGMENT"; "m_BEND ARC LENGTH"; "m_DUCTING RUNS"; "Mark"; }
code_block_10 = CodeBlock { "Total Length of Run"; }
code_block_11 = CodeBlock { "Duct Count"; }

# group: Review
getParameterValueByName = Element.GetParameterValueByName(element=watch_2, parameterName=code_block_7, lacing=Longest)

# group: Sort number at end
watch_3 = Watch(getParameterValueByName)
code_block_12 = CodeBlock { " "; }
split = String.Split(string=watch_3, separator0=code_block_12)
reverse_list_using_python_node = Python(IN[0]=split)  # "Reverse List Using Python Node - get number at end of text"; CPython3
# ---------- reverse_list_using_python_node.python (1 lines) ----------
OUT = map(lambda x: x[::-1], IN[0])
# ----------------------------------------
transpose = List.Transpose(lists=reverse_list_using_python_node)
code_block_13 = CodeBlock { 0; }
getItemAtIndex = List.GetItemAtIndex(list=transpose, index=code_block_13)
watch_4 = Watch(getItemAtIndex)

# group: Review
number = DoubleInput(1)  # graph input
count = List.Count(list=watch_2)
code_block_14 = CodeBlock(num=number, x=count) { num..x+num-1; }
string_from_object = FromObject(object=code_block_14)
lastItem = List.LastItem(list=string_from_object)

# group: m_Duct_Number Sequence > Combine
code_block_15 = CodeBlock(a=watch_4, b=string_from_object) { a+"_"+b; }

# group: m_Duct_Number Sequence
setParameterByName_2 = Element.SetParameterByName(element=watch_2, parameterName=code_block_6, value=code_block_15)

# group: Paramter used
code_block_16 = CodeBlock { "System Name"; "Bend Arc Length"; "Number Sequence"; "Radius"; "Section Type"; "Length"; "Cumulative Length(m)"; }

# group: Number Sequence_Fitting Duct_Duct
getParameterValueByName_2 = Element.GetParameterValueByName(element=watch_2, parameterName=code_block_16.out2)
watch_5 = Watch(getParameterValueByName_2)

# group: Create list to sort ID
list_create = List.Create(item0=watch_5)
watch_6 = Watch(list_create)

# group: Length (m)
bend_arc_length = Element.GetParameterValueByName(element=watch_2, parameterName=code_block_16.out1)
watch_7 = Watch(bend_arc_length)
duct_length = Element.GetParameterValueByName(element=watch_2, parameterName=code_block_16.out5)
watch_8 = Watch(duct_length)

# group: Cumulative sum
add = watch_7 + watch_8
list_create_2 = List.Create(item0=add)
string_tonumber_length_m = String.ToNumber(string=list_create_2)
python_script_cumulative_sum = Python(IN[0]=string_tonumber_length_m)  # CPython3
# ---------- python_script_cumulative_sum.python (1 lines) ----------
OUT = [[sum(i[:j]) for j in range(1,len(i)+1)] for i in IN[0]]
# ----------------------------------------
watch_9 = Watch(python_script_cumulative_sum)

# group: Pick List
code_block_17 = CodeBlock { 1; }
getItemAtIndex_2 = List.GetItemAtIndex(index=code_block_17)  # unwired: list

# group: Return list
join = List.Join(list0=watch_6, list1=watch_9)
transpose_2 = List.Transpose(lists=join)
map = List.Map(list=transpose_2, function=getItemAtIndex_2)

# group: add sum to "Cumulative Length(m)
setParameterByName_3 = Element.SetParameterByName(element=watch_2, parameterName=code_block_8, value=map)
watch_10 = Watch(setParameterByName_3)

# group: Total Fitting
code_block_18 = CodeBlock(val=watch_7) { val == null ? 0 : val; }
code_block_19 = CodeBlock(val=code_block_18) { val == "" ? 0 : val; }
fitting_sum = Math.Sum(values=code_block_19)
watch_11 = Watch(fitting_sum)

# group: To Revit
transpose_3 = List.Transpose(lists=getParameterValueByName)  # frozen
code_block_20 = CodeBlock { 0; }
getItemAtIndex_3 = List.GetItemAtIndex(list=transpose_3, index=code_block_20)

# group: Total Duct
code_block_21 = CodeBlock(val=watch_8) { val == null ? 0 : val; }
code_block_22 = CodeBlock(val=code_block_21) { val == "" ? 0 : val; }
duct_sum = Math.Sum(values=code_block_22)
watch_12 = Watch(duct_sum)

# group: Not in uses
setParameterByName_4 = Element.SetParameterByName()  # unwired: element, parameterName, value
watch_13 = Watch(setParameterByName_4)
setParameterByName_5 = Element.SetParameterByName(parameterName=code_block_9.out1, value=watch_11)  # unwired: element
watch_14 = Watch(setParameterByName_5)
setParameterByName_6 = Element.SetParameterByName(parameterName=code_block_9.out0, value=watch_12)  # unwired: element
watch_15 = Watch(setParameterByName_6)

# group: Total Length of Run
sum = Math.Sum(values=map)
setParameterByName_7 = Element.SetParameterByName(element=watch_2, parameterName=code_block_10, value=sum)
watch_16 = Watch(setParameterByName_7)

# group: Duct Count by Group
count_2 = List.Count(list=map)
round = Math.Round(number=count_2)
setParameterByName_8 = Element.SetParameterByName(element=watch_2, parameterName=code_block_11, value=round)

watch_17 = Watch(watch_2)
indexnumber_start_at_0 = CodeBlock()
# ---------- indexnumber_start_at_0.designscript (36 lines) ----------
0;
1;
2;
3;
4;
5;
6;
7;
8;
9;
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35;
# ----------------------------------------

# group: Review
number_of_cable = DoubleInput(3)  # graph input
friction_f = DoubleInput(0.2)  # graph input
d_cable_od_mm = DoubleInput(61)  # graph input
d_duct_id_mm = DoubleInput(150.2)  # graph input
w_weight_per_cable_kg_m = DoubleInput(4.45)  # graph input
gravity_9_8_n_kg = DoubleInput(9.8)  # graph input
allowable_tension_n = DoubleInput(30000)  # graph input
allowable_sidewall_n_m = DoubleInput(7000)  # graph input
cable_Arrangement = CustomSelection("Trefoil", items={Single: "Single", Trefoil: "Trefoil"})  # graph input
cable_reference = StringInput("NA2XS(F)2Y 12/20kV 1x1000RM/35")  # graph input

# group: 4.7 Weight correction factor - IEEEE standard (Wc) Up to a D/d ratio of 2.5, cables are constrained into a triangular configuration. Wc for this arrangement may be calculated using Equation (7b).
f = CodeBlock(f=friction_f) { f*1; }
d_d = CodeBlock(d=d_cable_od_mm, D=d_duct_id_mm) { d/(D-d); }
decimal_place = CodeBlock { 3; }
# note: Formula
# Expected sidewall pressure
# For single conductor or one cable
# P=T1/R
# For three cables in triangular formation where pressure is divided equally between two bottom cables:
# P=(Wc x t1)/(2 x R)
# Weight correction factor
# f' = Wc x f
# WC
# 1.0 Up to a D/d ratio of 2.5
# Wc = 1/ sqrt(1-[ d/(D-d)]^2)
# 2.0 between 2.5 and 3.0
# Wc = 1+2([ d/(D-d)]^2)
# 3.0 For D/d ratios above 3.0
# Wc =  1  +  (4/3)[ d/(D-d)]^2
# note: 1. The cables are pulled using only a "Triple Stocking for Pulling Three Cable Cores", type K50/3 as per ESBN's "MV/LV Installations Standards and Practice Manual". NOTE: A single stocking encompassing the three cables must not be used based on these calculations as the cable will be damaged beyond repair.
# 2. When the pulling begins as per above method, tie wraps will be used to every 5m to secure the cables in a trefoil formation for the duration of that section.
# 3. Approved lubricant must be used as per the recommended quantities in section 2.7.10 of the"MV/LV Installations Standards and Practice Manual".
ratio_d_d = CodeBlock(D=d_duct_id_mm, d=d_cable_od_mm) { D/d; }
code_block_23 = CodeBlock { 1; }
over_2_5 = CodeBlock(Ratio=ratio_d_d, Results=code_block_23) { Ratio<=2.5?Results:1; }
over_2_5_2 = CodeBlock(Ratio=ratio_d_d, Results=code_block_23) { Ratio>=2.5?Results:0; }
over_3 = CodeBlock(Ratio=ratio_d_d, Results=code_block_23) { Ratio>=3?Results:0; }
code_block_24 = CodeBlock(a=over_2_5, b=over_2_5_2, c=over_3) { a+b+c; }

# group: 4.7 Weight correction factor - IEEEE standard (Wc) Up to a D/d ratio of 2.5, cables are constrained into a triangular configuration. Wc for this arrangement may be calculated using Equation (7b). >  [(d/dD-d) ^2]
d_d_d_2 = CodeBlock(x=d_d) { DSCore.Math.Pow(x,2); }

# group (continued): 4.7 Weight correction factor - IEEEE standard (Wc) Up to a D/d ratio of 2.5, cables are constrained into a triangular configuration. Wc for this arrangement may be calculated using Equation (7b).
n2_5_1_d_d_d_2 = CodeBlock(a=d_d_d_2) { 1-a; }  # "2.5 = (1- [(d/D-d) ^2])"
sqrt_1_d_d_d_2 = Math.Sqrt(number=n2_5_1_d_d_d_2)

# group: 4.7 Weight correction factor - IEEEE standard (Wc) Up to a D/d ratio of 2.5, cables are constrained into a triangular configuration. Wc for this arrangement may be calculated using Equation (7b). > Up 2.5, bewtwwn 2.5-3 and over 3
wc_up_to_a_d_d_ratio_of_2_5 = CodeBlock(a=sqrt_1_d_d_d_2) { 1/a; }
d_d_ratio_between_2_5_and_3_0_1 = CodeBlock(a=d_d_d_2) { 1+(2*a); }  # "D/d ratio between 2.5 and 3.0 = 1+2([ d/(D-d)]^2)"
d_d_ratios_above_3_0_1_4_3_d_d_d = CodeBlock(a=d_d_d_2) { (1)+((4/3)*a); }  # "D/d ratios above 3.0 = 1 + ((4/3) [(d/D-d) ^2])"

# group (continued): 4.7 Weight correction factor - IEEEE standard (Wc) Up to a D/d ratio of 2.5, cables are constrained into a triangular configuration. Wc for this arrangement may be calculated using Equation (7b).
wc_if_assume_triangular = CodeBlock(Wc2_5=wc_up_to_a_d_d_ratio_of_2_5) { Wc2_5; }  # "----Wc----- if Assume triangular configuration"
use_wc_result_here = CodeBlock(Wc=wc_if_assume_triangular) { Wc; }
the_effective_coefficient_of_f_f = CodeBlock(f=f, WC=use_wc_result_here) { f*WC; }  # "The effective coefficient of (f) = F'=Wc*f"
over_1_f = CodeBlock(NoOFCable=number_of_cable, f=f, Fc=the_effective_coefficient_of_f_f) { NoOFCable==1?f:Fc; }
round_f_to_3_decimal_placee = Math.Round(number=over_1_f, digits=decimal_place)
wc_or_w = CodeBlock(F=friction_f, F1=over_1_f, r1=use_wc_result_here) { F==F1?1:r1; }
wc_cables_with_a_d_d_ratio = CodeBlock(Ratio=code_block_24, A25=wc_up_to_a_d_d_ratio_of_2_5, A3=d_d_ratio_between_2_5_and_3_0_1) { Ratio>=2?A25:A3; }  # "WC=Cables with a D/d ratio between 2.5 and 3.0"; frozen

# group: Wc---- triangular configuration
f_or_f = CodeBlock(f=round_f_to_3_decimal_placee) { f*1; }
cable_number_weight = CodeBlock(NUM=number_of_cable, W=w_weight_per_cable_kg_m) { NUM*W; }
t1_entry_tension_kg_or_n = CodeBlock(G=gravity_9_8_n_kg) { 200*G; }
d_cable_mm = CodeBlock(d=d_cable_od_mm) { d*1; }
d_conduit_inside_mm = CodeBlock(D1=d_duct_id_mm) { D1*1; }
wc = CodeBlock(Wc=wc_or_w) { Wc; }
gravity = CodeBlock(G=gravity_9_8_n_kg) { G*1; }
allowable_tension_n_2 = CodeBlock(Atn=allowable_tension_n) { Atn*1; }
allowable_sidewall_n_m_2 = CodeBlock(AsNm=allowable_sidewall_n_m) { AsNm*1; }

# group: Annotation
pullCal_V9 = Custom[PullCal_V9](All_Element=watch_17, IndexNumber=indexnumber_start_at_0.out0, f=f_or_f, w=cable_number_weight, T1_N=t1_entry_tension_kg_or_n, d_cable=d_cable_mm, D_conduit=d_conduit_inside_mm, No_Of_Conductors=number_of_cable, Wc=wc, Gravity=gravity)  # PullCal_V9 bt ConorMcenery_ base on TB194
pullCal_V9_2 = Custom[PullCal_V9](All_Element=watch_17, IndexNumber=indexnumber_start_at_0.out1, f=f_or_f, w=cable_number_weight, T1_N=pullCal_V9.T2_N, d_cable=d_cable_mm, D_conduit=d_conduit_inside_mm, No_Of_Conductors=number_of_cable, Wc=wc, Gravity=gravity)
pullCal_V9_3 = Custom[PullCal_V9](All_Element=watch_17, IndexNumber=indexnumber_start_at_0.out2, f=f_or_f, w=cable_number_weight, T1_N=pullCal_V9_2.T2_N, d_cable=d_cable_mm, D_conduit=d_conduit_inside_mm, No_Of_Conductors=number_of_cable, Wc=wc, Gravity=gravity)
pullCal_V9_4 = Custom[PullCal_V9](All_Element=watch_17, IndexNumber=indexnumber_start_at_0.out3, f=f_or_f, w=cable_number_weight, T1_N=pullCal_V9_3.T2_N, d_cable=d_cable_mm, D_conduit=d_conduit_inside_mm, No_Of_Conductors=number_of_cable, Wc=wc, Gravity=gravity)
pullCal_V9_5 = Custom[PullCal_V9](All_Element=watch_17, IndexNumber=indexnumber_start_at_0.out4, f=f_or_f, w=cable_number_weight, T1_N=pullCal_V9_4.T2_N, d_cable=d_cable_mm, D_conduit=d_conduit_inside_mm, No_Of_Conductors=number_of_cable, Wc=wc, Gravity=gravity)
pullCal_V9_6 = Custom[PullCal_V9](All_Element=watch_17, IndexNumber=indexnumber_start_at_0.out5, f=f_or_f, w=cable_number_weight, T1_N=pullCal_V9_5.T2_N, d_cable=d_cable_mm, D_conduit=d_conduit_inside_mm, No_Of_Conductors=number_of_cable, Wc=wc, Gravity=gravity)
pullCal_V9_7 = Custom[PullCal_V9](All_Element=watch_17, IndexNumber=indexnumber_start_at_0.out6, f=f_or_f, w=cable_number_weight, T1_N=pullCal_V9_6.T2_N, d_cable=d_cable_mm, D_conduit=d_conduit_inside_mm, No_Of_Conductors=number_of_cable, Wc=wc, Gravity=gravity)
pullCal_V9_8 = Custom[PullCal_V9](All_Element=watch_17, IndexNumber=indexnumber_start_at_0.out7, f=f_or_f, w=cable_number_weight, T1_N=pullCal_V9_7.T2_N, d_cable=d_cable_mm, D_conduit=d_conduit_inside_mm, No_Of_Conductors=number_of_cable, Wc=wc, Gravity=gravity)
pullCal_V9_9 = Custom[PullCal_V9](All_Element=watch_17, IndexNumber=indexnumber_start_at_0.out8, f=f_or_f, w=cable_number_weight, T1_N=pullCal_V9_8.T2_N, d_cable=d_cable_mm, D_conduit=d_conduit_inside_mm, No_Of_Conductors=number_of_cable, Wc=wc, Gravity=gravity)
pullCal_V9_10 = Custom[PullCal_V9](All_Element=watch_17, IndexNumber=indexnumber_start_at_0.out9, f=f_or_f, w=cable_number_weight, T1_N=pullCal_V9_9.T2_N, d_cable=d_cable_mm, D_conduit=d_conduit_inside_mm, No_Of_Conductors=number_of_cable, Wc=wc, Gravity=gravity)
pullCal_V9_11 = Custom[PullCal_V9](All_Element=watch_17, IndexNumber=indexnumber_start_at_0.out10, f=f_or_f, w=cable_number_weight, T1_N=pullCal_V9_10.T2_N, d_cable=d_cable_mm, D_conduit=d_conduit_inside_mm, No_Of_Conductors=number_of_cable, Wc=wc, Gravity=gravity)
pullCal_V9_12 = Custom[PullCal_V9](All_Element=watch_17, IndexNumber=indexnumber_start_at_0.out11, f=f_or_f, w=cable_number_weight, T1_N=pullCal_V9_11.T2_N, d_cable=d_cable_mm, D_conduit=d_conduit_inside_mm, No_Of_Conductors=number_of_cable, Wc=wc, Gravity=gravity)
pullCal_V9_13 = Custom[PullCal_V9](All_Element=watch_17, IndexNumber=indexnumber_start_at_0.out12, f=f_or_f, w=cable_number_weight, T1_N=pullCal_V9_12.T2_N, d_cable=d_cable_mm, D_conduit=d_conduit_inside_mm, No_Of_Conductors=number_of_cable, Wc=wc, Gravity=gravity)
pullCal_V9_14 = Custom[PullCal_V9](All_Element=watch_17, IndexNumber=indexnumber_start_at_0.out13, f=f_or_f, w=cable_number_weight, T1_N=pullCal_V9_13.T2_N, d_cable=d_cable_mm, D_conduit=d_conduit_inside_mm, No_Of_Conductors=number_of_cable, Wc=wc, Gravity=gravity)
pullCal_V9_15 = Custom[PullCal_V9](All_Element=watch_17, IndexNumber=indexnumber_start_at_0.out14, f=f_or_f, w=cable_number_weight, T1_N=pullCal_V9_14.T2_N, d_cable=d_cable_mm, D_conduit=d_conduit_inside_mm, No_Of_Conductors=number_of_cable, Wc=wc, Gravity=gravity)
pullCal_V9_16 = Custom[PullCal_V9](All_Element=watch_17, IndexNumber=indexnumber_start_at_0.out15, f=f_or_f, w=cable_number_weight, T1_N=pullCal_V9_15.T2_N, d_cable=d_cable_mm, D_conduit=d_conduit_inside_mm, No_Of_Conductors=number_of_cable, Wc=wc, Gravity=gravity)
pullCal_V9_17 = Custom[PullCal_V9](All_Element=watch_17, IndexNumber=indexnumber_start_at_0.out16, f=f_or_f, w=cable_number_weight, T1_N=pullCal_V9_16.T2_N, d_cable=d_cable_mm, D_conduit=d_conduit_inside_mm, No_Of_Conductors=number_of_cable, Wc=wc, Gravity=gravity)
pullCal_V9_18 = Custom[PullCal_V9](All_Element=watch_17, IndexNumber=indexnumber_start_at_0.out17, f=f_or_f, w=cable_number_weight, T1_N=pullCal_V9_17.T2_N, d_cable=d_cable_mm, D_conduit=d_conduit_inside_mm, No_Of_Conductors=number_of_cable, Wc=wc, Gravity=gravity)
pullCal_V9_19 = Custom[PullCal_V9](All_Element=watch_17, IndexNumber=indexnumber_start_at_0.out18, f=f_or_f, w=cable_number_weight, T1_N=pullCal_V9_18.T2_N, d_cable=d_cable_mm, D_conduit=d_conduit_inside_mm, No_Of_Conductors=number_of_cable, Wc=wc, Gravity=gravity)
pullCal_V9_20 = Custom[PullCal_V9](All_Element=watch_17, IndexNumber=indexnumber_start_at_0.out19, f=f_or_f, w=cable_number_weight, T1_N=pullCal_V9_19.T2_N, d_cable=d_cable_mm, D_conduit=d_conduit_inside_mm, No_Of_Conductors=number_of_cable, Wc=wc, Gravity=gravity)
pullCal_V9_21 = Custom[PullCal_V9](All_Element=watch_17, IndexNumber=indexnumber_start_at_0.out20, f=f_or_f, w=cable_number_weight, T1_N=pullCal_V9_20.T2_N, d_cable=d_cable_mm, D_conduit=d_conduit_inside_mm, No_Of_Conductors=number_of_cable, Wc=wc, Gravity=gravity)
pullCal_V9_22 = Custom[PullCal_V9](All_Element=watch_17, IndexNumber=indexnumber_start_at_0.out21, f=f_or_f, w=cable_number_weight, T1_N=pullCal_V9_21.T2_N, d_cable=d_cable_mm, D_conduit=d_conduit_inside_mm, No_Of_Conductors=number_of_cable, Wc=wc, Gravity=gravity)
pullCal_V9_23 = Custom[PullCal_V9](All_Element=watch_17, IndexNumber=indexnumber_start_at_0.out22, f=f_or_f, w=cable_number_weight, T1_N=pullCal_V9_22.T2_N, d_cable=d_cable_mm, D_conduit=d_conduit_inside_mm, No_Of_Conductors=number_of_cable, Wc=wc, Gravity=gravity)
pullCal_V9_24 = Custom[PullCal_V9](All_Element=watch_17, IndexNumber=indexnumber_start_at_0.out23, f=f_or_f, w=cable_number_weight, T1_N=pullCal_V9_23.T2_N, d_cable=d_cable_mm, D_conduit=d_conduit_inside_mm, No_Of_Conductors=number_of_cable, Wc=wc, Gravity=gravity)
pullCal_V9_25 = Custom[PullCal_V9](All_Element=watch_17, IndexNumber=indexnumber_start_at_0.out24, f=f_or_f, w=cable_number_weight, T1_N=pullCal_V9_24.T2_N, d_cable=d_cable_mm, D_conduit=d_conduit_inside_mm, No_Of_Conductors=number_of_cable, Wc=wc, Gravity=gravity)
pullCal_V9_26 = Custom[PullCal_V9](All_Element=watch_17, IndexNumber=indexnumber_start_at_0.out25, f=f_or_f, w=cable_number_weight, T1_N=pullCal_V9_25.T2_N, d_cable=d_cable_mm, D_conduit=d_conduit_inside_mm, No_Of_Conductors=number_of_cable, Wc=wc, Gravity=gravity)
pullCal_V9_27 = Custom[PullCal_V9](All_Element=watch_17, IndexNumber=indexnumber_start_at_0.out26, f=f_or_f, w=cable_number_weight, T1_N=pullCal_V9_26.T2_N, d_cable=d_cable_mm, D_conduit=d_conduit_inside_mm, No_Of_Conductors=number_of_cable, Wc=wc, Gravity=gravity)
pullCal_V9_28 = Custom[PullCal_V9](All_Element=watch_17, IndexNumber=indexnumber_start_at_0.out27, f=f_or_f, w=cable_number_weight, T1_N=pullCal_V9_27.T2_N, d_cable=d_cable_mm, D_conduit=d_conduit_inside_mm, No_Of_Conductors=number_of_cable, Wc=wc, Gravity=gravity)
pullCal_V9_29 = Custom[PullCal_V9](All_Element=watch_17, IndexNumber=indexnumber_start_at_0.out28, f=f_or_f, w=cable_number_weight, T1_N=pullCal_V9_28.T2_N, d_cable=d_cable_mm, D_conduit=d_conduit_inside_mm, No_Of_Conductors=number_of_cable, Wc=wc, Gravity=gravity)
pullCal_V9_30 = Custom[PullCal_V9](All_Element=watch_17, IndexNumber=indexnumber_start_at_0.out29, f=f_or_f, w=cable_number_weight, T1_N=pullCal_V9_29.T2_N, d_cable=d_cable_mm, D_conduit=d_conduit_inside_mm, No_Of_Conductors=number_of_cable, Wc=wc, Gravity=gravity)
pullCal_V9_31 = Custom[PullCal_V9](All_Element=watch_17, IndexNumber=indexnumber_start_at_0.out30, f=f_or_f, w=cable_number_weight, T1_N=pullCal_V9_30.T2_N, d_cable=d_cable_mm, D_conduit=d_conduit_inside_mm, No_Of_Conductors=number_of_cable, Wc=wc, Gravity=gravity)
pullCal_V9_32 = Custom[PullCal_V9](All_Element=watch_17, IndexNumber=indexnumber_start_at_0.out31, f=f_or_f, w=cable_number_weight, T1_N=pullCal_V9_31.T2_N, d_cable=d_cable_mm, D_conduit=d_conduit_inside_mm, No_Of_Conductors=number_of_cable, Wc=wc, Gravity=gravity)
pullCal_V9_33 = Custom[PullCal_V9](All_Element=watch_17, IndexNumber=indexnumber_start_at_0.out32, f=f_or_f, w=cable_number_weight, T1_N=pullCal_V9_32.T2_N, d_cable=d_cable_mm, D_conduit=d_conduit_inside_mm, No_Of_Conductors=number_of_cable, Wc=wc, Gravity=gravity)
pullCal_V9_34 = Custom[PullCal_V9](All_Element=watch_17, IndexNumber=indexnumber_start_at_0.out33, f=f_or_f, w=cable_number_weight, T1_N=pullCal_V9_33.T2_N, d_cable=d_cable_mm, D_conduit=d_conduit_inside_mm, No_Of_Conductors=number_of_cable, Wc=wc, Gravity=gravity)
pullCal_V9_35 = Custom[PullCal_V9](All_Element=watch_17, IndexNumber=indexnumber_start_at_0.out34, f=f_or_f, w=cable_number_weight, T1_N=pullCal_V9_34.T2_N, d_cable=d_cable_mm, D_conduit=d_conduit_inside_mm, No_Of_Conductors=number_of_cable, Wc=wc, Gravity=gravity)
pullCal_V9_36 = Custom[PullCal_V9](All_Element=watch_17, IndexNumber=indexnumber_start_at_0.out35, f=f_or_f, w=cable_number_weight, T1_N=pullCal_V9_35.T2_N, d_cable=d_cable_mm, D_conduit=d_conduit_inside_mm, No_Of_Conductors=number_of_cable, Wc=wc, Gravity=gravity)

code_block_25 = CodeBlock { "T2_kg"; "T2_(n)"; }
T2_N_Value = List.Create(item0=pullCal_V9.T2_N, item1=pullCal_V9_2.T2_N, item2=pullCal_V9_3.T2_N, item3=pullCal_V9_4.T2_N, item4=pullCal_V9_5.T2_N, item5=pullCal_V9_6.T2_N, item6=pullCal_V9_7.T2_N, item7=pullCal_V9_8.T2_N, item8=pullCal_V9_9.T2_N, item9=pullCal_V9_10.T2_N, item10=pullCal_V9_11.T2_N, item11=pullCal_V9_12.T2_N, item12=pullCal_V9_13.T2_N, item13=pullCal_V9_14.T2_N, item14=pullCal_V9_15.T2_N, item15=pullCal_V9_16.T2_N, item16=pullCal_V9_17.T2_N, item17=pullCal_V9_18.T2_N, item18=pullCal_V9_19.T2_N, item19=pullCal_V9_20.T2_N, item20=pullCal_V9_21.T2_N, item21=pullCal_V9_22.T2_N, item22=pullCal_V9_23.T2_N, item23=pullCal_V9_24.T2_N, item24=pullCal_V9_25.T2_N, item25=pullCal_V9_26.T2_N, item26=pullCal_V9_27.T2_N, item27=pullCal_V9_28.T2_N, item28=pullCal_V9_29.T2_N, item29=pullCal_V9_30.T2_N, item30=pullCal_V9_31.T2_N, item31=pullCal_V9_32.T2_N, item32=pullCal_V9_33.T2_N, item33=pullCal_V9_34.T2_N, item34=pullCal_V9_35.T2_N, item35=pullCal_V9_36.T2_N)

# group: To Revit
element = List.Create(item0=pullCal_V9.Element, item1=pullCal_V9_2.Element, item2=pullCal_V9_3.Element, item3=pullCal_V9_4.Element, item4=pullCal_V9_5.Element, item5=pullCal_V9_6.Element, item6=pullCal_V9_7.Element, item7=pullCal_V9_8.Element, item8=pullCal_V9_9.Element, item9=pullCal_V9_10.Element, item10=pullCal_V9_11.Element, item11=pullCal_V9_12.Element, item12=pullCal_V9_13.Element, item13=pullCal_V9_14.Element, item14=pullCal_V9_15.Element, item15=pullCal_V9_16.Element, item16=pullCal_V9_17.Element, item17=pullCal_V9_18.Element, item18=pullCal_V9_19.Element, item19=pullCal_V9_20.Element, item20=pullCal_V9_21.Element, item21=pullCal_V9_22.Element, item22=pullCal_V9_23.Element, item23=pullCal_V9_24.Element, item24=pullCal_V9_25.Element, item25=pullCal_V9_26.Element, item26=pullCal_V9_27.Element, item27=pullCal_V9_28.Element, item28=pullCal_V9_29.Element, item29=pullCal_V9_30.Element, item30=pullCal_V9_31.Element, item31=pullCal_V9_32.Element, item32=pullCal_V9_33.Element, item33=pullCal_V9_34.Element, item34=pullCal_V9_35.Element, item35=pullCal_V9_36.Element)
clean_element = List.Clean(list=element)
code_n = CodeBlock(val=T2_N_Value) { val == 0 ? null : val; }
clean_Value = List.Clean(list=code_n)

N = Math.Round(number=clean_Value)
t_f_n = Element.SetParameterByName(element=clean_element, parameterName=code_block_25.out1, value=N)

# group: Review
vh_deg = CodeBlock { "VH Deg"; }
gradient_Atan = CodeBlock { "Gradient_Atan"; }
angle_rad_number = CodeBlock { "Angle Rad_Number"; }
angle = CodeBlock { "Fitting Angle"; }

# group: Outputs
section_type_2 = CodeBlock { "Section Type"; }
section_type_3 = Element.GetParameterValueByName(element=watch_2, parameterName=section_type_2)
code_block_26 = CodeBlock { "Straight or horizontal"; }
boolean = BoolSelector(false)
if_statment = CodeBlock(SectionType=section_type_3, NameCode=code_block_26, Results=boolean) { SectionType==NameCode?Results:0; }

# group: Annotation
code_block_27 = CodeBlock { "Slope"; }
getParameterValueByName_3 = Element.GetParameterValueByName(element=watch_2, parameterName=code_block_27)
code_block_28 = CodeBlock(a=if_statment, b=getParameterValueByName_3) { a+b; }
slope_in = CodeBlock(val=code_block_28) { val == null ? 0 : val; }
DUCT = Watch(slope_in)
code_block_29 = CodeBlock(a=DUCT) { a/100; }
null = CodeBlock(val=code_block_29) { val == null ? 0 : val; }
atan = Math.Atan(ratio=null)
here_degrees_to_θ = CodeBlock(val=atan) { val == 0 ? null : val; }
gradient_radθ_0_0174532rad = CodeBlock(dEGE=here_degrees_to_θ) { dEGE*(3.141592654/180); }

# group: Slope to Tan
code_block_30 = CodeBlock(a=DUCT) { a/100; }
code_block_31 = CodeBlock(val=code_block_30) { val == null ? 0 : val; }
code_block_32 = CodeBlock(val=code_block_31) { val == "" ? 0 : val; }
atan_2 = Math.Atan(ratio=code_block_32)

# group: % Slope to Degree - VH Deg
vh_deg_2 = Element.SetParameterByName(element=watch_2, parameterName=vh_deg, value=atan_2)

# group: Review
gradient_Rad = CodeBlock { "Gradient_Rad"; }
radius = CodeBlock { "m_Radius"; }
friction = CodeBlock { "Friction(f)"; }
weight = CodeBlock { "Weight(w)"; }
code_block_33 = CodeBlock { "Duct Radius(M)"; }
d_d_number = CodeBlock { "Conduit Inside(mm)"; "Cable Outside(mm)"; "Cables in Duct"; }
weight_correction_wc = CodeBlock { "Weight_Correction(Wc)"; }
of_conductor_fill = CodeBlock { "%_of_Conductor_Fill"; }
cable_Reference = CodeBlock { "Cable_Reference"; }
weight_Per_Cable = CodeBlock { "Weight_Per_Cable"; }

# group: "Gradient Rad" DUCT
sinΘ = CodeBlock(val=gradient_radθ_0_0174532rad) { val == null ? 0 : val; }
gradient_rad = Element.SetParameterByName(element=watch_2, parameterName=gradient_Rad, value=sinΘ)
sinΘ_2 = CodeBlock(val=here_degrees_to_θ) { val == null ? 0 : val; }
gradient_Atan_2 = Element.SetParameterByName(element=watch_2, parameterName=gradient_Atan, value=sinΘ_2)

# group: Duct Count by Group
code_block_34 = CodeBlock { "Weight(w)"; }
setParameterByName_9 = Element.SetParameterByName(element=watch_2, parameterName=code_block_34, value=cable_number_weight)

# group: Horizontal Bend > Review
code_block_35 = CodeBlock { "Bend Arc Length"; "Center Radius"; }

# group: Horizontal Bend
getParameterValueByName_4 = Element.GetParameterValueByName(element=watch_2, parameterName=code_block_35.out0)
watch_18 = Watch(getParameterValueByName_4)
getParameterValueByName_5 = Element.GetParameterValueByName(element=watch_2, parameterName=code_block_35.out1)
watch_19 = Watch(getParameterValueByName_5)
code_block_36 = CodeBlock(a=watch_18, b=watch_19) { 1*(a/b); }
code_block_37 = CodeBlock(val=code_block_36) { val == null ? 0 : val; }
r_blank_too_0 = CodeBlock(val=watch_19) { val == "" ? 0 : val; }

# group: "Angle (included) Rad" Fitting
setParameterByName_10 = Element.SetParameterByName(element=watch_2, parameterName=angle_rad_number, value=code_block_37)

# group: Radius
setParameterByName_11 = Element.SetParameterByName(element=watch_2, parameterName=radius, value=r_blank_too_0)

# group: AGradient RadΘngle
angle_2 = Element.GetParameterValueByName(element=watch_2, parameterName=angle)
r_blank_too_0_2 = CodeBlock(val=angle_2) { val == "" ? 0 : val; }
gradient_rad_0_017453292rad = CodeBlock(dEGE=angle_2) { dEGE*(3.141592654/180); }

reverse = List.Reverse(list=watch_2)
watch_20 = Watch(reverse)
indexnumber_start_at_0_2 = CodeBlock()  # same code as indexnumber_start_at_0

# group: Outputs
pullCall_V9_Reverse = Custom[PullCall_V9_Reverse](All_Element_Reverse=watch_20, IndexNumber=indexnumber_start_at_0_2.out0, f=f_or_f, w=cable_number_weight, T1_N=t1_entry_tension_kg_or_n, D_conduit=d_conduit_inside_mm, d_cable=d_cable_mm, No_Of_Conductors=number_of_cable, Wc=wc, Gravity=gravity)  # PullCall_V9_Reverse - TB194 - ConorMcEnery
pullCall_V9_Reverse_2 = Custom[PullCall_V9_Reverse](All_Element_Reverse=watch_20, IndexNumber=indexnumber_start_at_0_2.out1, f=f_or_f, w=cable_number_weight, T1_N=pullCall_V9_Reverse.Reverse_T2_N, D_conduit=d_conduit_inside_mm, d_cable=d_cable_mm, No_Of_Conductors=number_of_cable, Wc=wc, Gravity=gravity)
pullCall_V9_Reverse_3 = Custom[PullCall_V9_Reverse](All_Element_Reverse=watch_20, IndexNumber=indexnumber_start_at_0_2.out2, f=f_or_f, w=cable_number_weight, T1_N=pullCall_V9_Reverse_2.Reverse_T2_N, D_conduit=d_conduit_inside_mm, d_cable=d_cable_mm, No_Of_Conductors=number_of_cable, Wc=wc, Gravity=gravity)
pullCall_V9_Reverse_4 = Custom[PullCall_V9_Reverse](All_Element_Reverse=watch_20, IndexNumber=indexnumber_start_at_0_2.out3, f=f_or_f, w=cable_number_weight, T1_N=pullCall_V9_Reverse_3.Reverse_T2_N, D_conduit=d_conduit_inside_mm, d_cable=d_cable_mm, No_Of_Conductors=number_of_cable, Wc=wc, Gravity=gravity)
pullCall_V9_Reverse_5 = Custom[PullCall_V9_Reverse](All_Element_Reverse=watch_20, IndexNumber=indexnumber_start_at_0_2.out4, f=f_or_f, w=cable_number_weight, T1_N=pullCall_V9_Reverse_4.Reverse_T2_N, D_conduit=d_conduit_inside_mm, d_cable=d_cable_mm, No_Of_Conductors=number_of_cable, Wc=wc, Gravity=gravity)
pullCall_V9_Reverse_6 = Custom[PullCall_V9_Reverse](All_Element_Reverse=watch_20, IndexNumber=indexnumber_start_at_0_2.out5, f=f_or_f, w=cable_number_weight, T1_N=pullCall_V9_Reverse_5.Reverse_T2_N, D_conduit=d_conduit_inside_mm, d_cable=d_cable_mm, No_Of_Conductors=number_of_cable, Wc=wc, Gravity=gravity)
pullCall_V9_Reverse_7 = Custom[PullCall_V9_Reverse](All_Element_Reverse=watch_20, IndexNumber=indexnumber_start_at_0_2.out6, f=f_or_f, w=cable_number_weight, T1_N=pullCall_V9_Reverse_6.Reverse_T2_N, D_conduit=d_conduit_inside_mm, d_cable=d_cable_mm, No_Of_Conductors=number_of_cable, Wc=wc, Gravity=gravity)
pullCall_V9_Reverse_8 = Custom[PullCall_V9_Reverse](All_Element_Reverse=watch_20, IndexNumber=indexnumber_start_at_0_2.out7, f=f_or_f, w=cable_number_weight, T1_N=pullCall_V9_Reverse_7.Reverse_T2_N, D_conduit=d_conduit_inside_mm, d_cable=d_cable_mm, No_Of_Conductors=number_of_cable, Wc=wc, Gravity=gravity)
pullCall_V9_Reverse_9 = Custom[PullCall_V9_Reverse](All_Element_Reverse=watch_20, IndexNumber=indexnumber_start_at_0_2.out8, f=f_or_f, w=cable_number_weight, T1_N=pullCall_V9_Reverse_8.Reverse_T2_N, D_conduit=d_conduit_inside_mm, d_cable=d_cable_mm, No_Of_Conductors=number_of_cable, Wc=wc, Gravity=gravity)
pullCall_V9_Reverse_10 = Custom[PullCall_V9_Reverse](All_Element_Reverse=watch_20, IndexNumber=indexnumber_start_at_0_2.out9, f=f_or_f, w=cable_number_weight, T1_N=pullCall_V9_Reverse_9.Reverse_T2_N, D_conduit=d_conduit_inside_mm, d_cable=d_cable_mm, No_Of_Conductors=number_of_cable, Wc=wc, Gravity=gravity)
pullCall_V9_Reverse_11 = Custom[PullCall_V9_Reverse](All_Element_Reverse=watch_20, IndexNumber=indexnumber_start_at_0_2.out10, f=f_or_f, w=cable_number_weight, T1_N=pullCall_V9_Reverse_10.Reverse_T2_N, D_conduit=d_conduit_inside_mm, d_cable=d_cable_mm, No_Of_Conductors=number_of_cable, Wc=wc, Gravity=gravity)
pullCall_V9_Reverse_12 = Custom[PullCall_V9_Reverse](All_Element_Reverse=watch_20, IndexNumber=indexnumber_start_at_0_2.out11, f=f_or_f, w=cable_number_weight, T1_N=pullCall_V9_Reverse_11.Reverse_T2_N, D_conduit=d_conduit_inside_mm, d_cable=d_cable_mm, No_Of_Conductors=number_of_cable, Wc=wc, Gravity=gravity)
pullCall_V9_Reverse_13 = Custom[PullCall_V9_Reverse](All_Element_Reverse=watch_20, IndexNumber=indexnumber_start_at_0_2.out12, f=f_or_f, w=cable_number_weight, T1_N=pullCall_V9_Reverse_12.Reverse_T2_N, D_conduit=d_conduit_inside_mm, d_cable=d_cable_mm, No_Of_Conductors=number_of_cable, Wc=wc, Gravity=gravity)
pullCall_V9_Reverse_14 = Custom[PullCall_V9_Reverse](All_Element_Reverse=watch_20, IndexNumber=indexnumber_start_at_0_2.out13, f=f_or_f, w=cable_number_weight, T1_N=pullCall_V9_Reverse_13.Reverse_T2_N, D_conduit=d_conduit_inside_mm, d_cable=d_cable_mm, No_Of_Conductors=number_of_cable, Wc=wc, Gravity=gravity)
pullCall_V9_Reverse_15 = Custom[PullCall_V9_Reverse](All_Element_Reverse=watch_20, IndexNumber=indexnumber_start_at_0_2.out14, f=f_or_f, w=cable_number_weight, T1_N=pullCall_V9_Reverse_14.Reverse_T2_N, D_conduit=d_conduit_inside_mm, d_cable=d_cable_mm, No_Of_Conductors=number_of_cable, Wc=wc, Gravity=gravity)
pullCall_V9_Reverse_16 = Custom[PullCall_V9_Reverse](All_Element_Reverse=watch_20, IndexNumber=indexnumber_start_at_0_2.out15, f=f_or_f, w=cable_number_weight, T1_N=pullCall_V9_Reverse_15.Reverse_T2_N, D_conduit=d_conduit_inside_mm, d_cable=d_cable_mm, No_Of_Conductors=number_of_cable, Wc=wc, Gravity=gravity)
pullCall_V9_Reverse_17 = Custom[PullCall_V9_Reverse](All_Element_Reverse=watch_20, IndexNumber=indexnumber_start_at_0_2.out16, f=f_or_f, w=cable_number_weight, T1_N=pullCall_V9_Reverse_16.Reverse_T2_N, D_conduit=d_conduit_inside_mm, d_cable=d_cable_mm, No_Of_Conductors=number_of_cable, Wc=wc, Gravity=gravity)
pullCall_V9_Reverse_18 = Custom[PullCall_V9_Reverse](All_Element_Reverse=watch_20, IndexNumber=indexnumber_start_at_0_2.out17, f=f_or_f, w=cable_number_weight, T1_N=pullCall_V9_Reverse_17.Reverse_T2_N, D_conduit=d_conduit_inside_mm, d_cable=d_cable_mm, No_Of_Conductors=number_of_cable, Wc=wc, Gravity=gravity)
pullCall_V9_Reverse_19 = Custom[PullCall_V9_Reverse](All_Element_Reverse=watch_20, IndexNumber=indexnumber_start_at_0_2.out18, f=f_or_f, w=cable_number_weight, T1_N=pullCall_V9_Reverse_18.Reverse_T2_N, D_conduit=d_conduit_inside_mm, d_cable=d_cable_mm, No_Of_Conductors=number_of_cable, Wc=wc, Gravity=gravity)
pullCall_V9_Reverse_20 = Custom[PullCall_V9_Reverse](All_Element_Reverse=watch_20, IndexNumber=indexnumber_start_at_0_2.out19, f=f_or_f, w=cable_number_weight, T1_N=pullCall_V9_Reverse_19.Reverse_T2_N, D_conduit=d_conduit_inside_mm, d_cable=d_cable_mm, No_Of_Conductors=number_of_cable, Wc=wc, Gravity=gravity)
pullCall_V9_Reverse_21 = Custom[PullCall_V9_Reverse](All_Element_Reverse=watch_20, IndexNumber=indexnumber_start_at_0_2.out20, f=f_or_f, w=cable_number_weight, T1_N=pullCall_V9_Reverse_20.Reverse_T2_N, D_conduit=d_conduit_inside_mm, d_cable=d_cable_mm, No_Of_Conductors=number_of_cable, Wc=wc, Gravity=gravity)
pullCall_V9_Reverse_22 = Custom[PullCall_V9_Reverse](All_Element_Reverse=watch_20, IndexNumber=indexnumber_start_at_0_2.out21, f=f_or_f, w=cable_number_weight, T1_N=pullCall_V9_Reverse_21.Reverse_T2_N, D_conduit=d_conduit_inside_mm, d_cable=d_cable_mm, No_Of_Conductors=number_of_cable, Wc=wc, Gravity=gravity)
pullCall_V9_Reverse_23 = Custom[PullCall_V9_Reverse](All_Element_Reverse=watch_20, IndexNumber=indexnumber_start_at_0_2.out22, f=f_or_f, w=cable_number_weight, T1_N=pullCall_V9_Reverse_22.Reverse_T2_N, D_conduit=d_conduit_inside_mm, d_cable=d_cable_mm, No_Of_Conductors=number_of_cable, Wc=wc, Gravity=gravity)
pullCall_V9_Reverse_24 = Custom[PullCall_V9_Reverse](All_Element_Reverse=watch_20, IndexNumber=indexnumber_start_at_0_2.out23, f=f_or_f, w=cable_number_weight, T1_N=pullCall_V9_Reverse_23.Reverse_T2_N, D_conduit=d_conduit_inside_mm, d_cable=d_cable_mm, No_Of_Conductors=number_of_cable, Wc=wc, Gravity=gravity)
pullCall_V9_Reverse_25 = Custom[PullCall_V9_Reverse](All_Element_Reverse=watch_20, IndexNumber=indexnumber_start_at_0_2.out24, f=f_or_f, w=cable_number_weight, T1_N=pullCall_V9_Reverse_24.Reverse_T2_N, D_conduit=d_conduit_inside_mm, d_cable=d_cable_mm, No_Of_Conductors=number_of_cable, Wc=wc, Gravity=gravity)
pullCall_V9_Reverse_26 = Custom[PullCall_V9_Reverse](All_Element_Reverse=watch_20, IndexNumber=indexnumber_start_at_0_2.out25, f=f_or_f, w=cable_number_weight, T1_N=pullCall_V9_Reverse_25.Reverse_T2_N, D_conduit=d_conduit_inside_mm, d_cable=d_cable_mm, No_Of_Conductors=number_of_cable, Wc=wc, Gravity=gravity)
pullCall_V9_Reverse_27 = Custom[PullCall_V9_Reverse](All_Element_Reverse=watch_20, IndexNumber=indexnumber_start_at_0_2.out26, f=f_or_f, w=cable_number_weight, T1_N=pullCall_V9_Reverse_26.Reverse_T2_N, D_conduit=d_conduit_inside_mm, d_cable=d_cable_mm, No_Of_Conductors=number_of_cable, Wc=wc, Gravity=gravity)
pullCall_V9_Reverse_28 = Custom[PullCall_V9_Reverse](All_Element_Reverse=watch_20, IndexNumber=indexnumber_start_at_0_2.out27, f=f_or_f, w=cable_number_weight, T1_N=pullCall_V9_Reverse_27.Reverse_T2_N, D_conduit=d_conduit_inside_mm, d_cable=d_cable_mm, No_Of_Conductors=number_of_cable, Wc=wc, Gravity=gravity)
pullCall_V9_Reverse_29 = Custom[PullCall_V9_Reverse](All_Element_Reverse=watch_20, IndexNumber=indexnumber_start_at_0_2.out28, f=f_or_f, w=cable_number_weight, T1_N=pullCall_V9_Reverse_28.Reverse_T2_N, D_conduit=d_conduit_inside_mm, d_cable=d_cable_mm, No_Of_Conductors=number_of_cable, Wc=wc, Gravity=gravity)
pullCall_V9_Reverse_30 = Custom[PullCall_V9_Reverse](All_Element_Reverse=watch_20, IndexNumber=indexnumber_start_at_0_2.out29, f=f_or_f, w=cable_number_weight, T1_N=pullCall_V9_Reverse_29.Reverse_T2_N, D_conduit=d_conduit_inside_mm, d_cable=d_cable_mm, No_Of_Conductors=number_of_cable, Wc=wc, Gravity=gravity)
pullCall_V9_Reverse_31 = Custom[PullCall_V9_Reverse](All_Element_Reverse=watch_20, IndexNumber=indexnumber_start_at_0_2.out30, f=f_or_f, w=cable_number_weight, T1_N=pullCall_V9_Reverse_30.Reverse_T2_N, D_conduit=d_conduit_inside_mm, d_cable=d_cable_mm, No_Of_Conductors=number_of_cable, Wc=wc, Gravity=gravity)
pullCall_V9_Reverse_32 = Custom[PullCall_V9_Reverse](All_Element_Reverse=watch_20, IndexNumber=indexnumber_start_at_0_2.out31, f=f_or_f, w=cable_number_weight, T1_N=pullCall_V9_Reverse_31.Reverse_T2_N, D_conduit=d_conduit_inside_mm, d_cable=d_cable_mm, No_Of_Conductors=number_of_cable, Wc=wc, Gravity=gravity)
pullCall_V9_Reverse_33 = Custom[PullCall_V9_Reverse](All_Element_Reverse=watch_20, IndexNumber=indexnumber_start_at_0_2.out32, f=f_or_f, w=cable_number_weight, T1_N=pullCall_V9_Reverse_32.Reverse_T2_N, D_conduit=d_conduit_inside_mm, d_cable=d_cable_mm, No_Of_Conductors=number_of_cable, Wc=wc, Gravity=gravity)
pullCall_V9_Reverse_34 = Custom[PullCall_V9_Reverse](All_Element_Reverse=watch_20, IndexNumber=indexnumber_start_at_0_2.out33, f=f_or_f, w=cable_number_weight, T1_N=pullCall_V9_Reverse_33.Reverse_T2_N, D_conduit=d_conduit_inside_mm, d_cable=d_cable_mm, No_Of_Conductors=number_of_cable, Wc=wc, Gravity=gravity)
pullCall_V9_Reverse_35 = Custom[PullCall_V9_Reverse](All_Element_Reverse=watch_20, IndexNumber=indexnumber_start_at_0_2.out34, f=f_or_f, w=cable_number_weight, T1_N=pullCall_V9_Reverse_34.Reverse_T2_N, D_conduit=d_conduit_inside_mm, d_cable=d_cable_mm, No_Of_Conductors=number_of_cable, Wc=wc, Gravity=gravity)
pullCall_V9_Reverse_36 = Custom[PullCall_V9_Reverse](All_Element_Reverse=watch_20, IndexNumber=indexnumber_start_at_0_2.out35, f=f_or_f, w=cable_number_weight, T1_N=pullCall_V9_Reverse_35.Reverse_T2_N, D_conduit=d_conduit_inside_mm, d_cable=d_cable_mm, No_Of_Conductors=number_of_cable, Wc=wc, Gravity=gravity)

# group: Review
element_2 = List.Create(item0=pullCall_V9_Reverse.Element, item1=pullCall_V9_Reverse_2.Element, item2=pullCall_V9_Reverse_3.Element, item3=pullCall_V9_Reverse_4.Element, item4=pullCall_V9_Reverse_5.Element, item5=pullCall_V9_Reverse_6.Element, item6=pullCall_V9_Reverse_7.Element, item7=pullCall_V9_Reverse_8.Element, item8=pullCall_V9_Reverse_9.Element, item9=pullCall_V9_Reverse_10.Element, item10=pullCall_V9_Reverse_11.Element, item11=pullCall_V9_Reverse_12.Element, item12=pullCall_V9_Reverse_13.Element, item13=pullCall_V9_Reverse_14.Element, item14=pullCall_V9_Reverse_15.Element, item15=pullCall_V9_Reverse_16.Element, item16=pullCall_V9_Reverse_17.Element, item17=pullCall_V9_Reverse_18.Element, item18=pullCall_V9_Reverse_19.Element, item19=pullCall_V9_Reverse_20.Element, item20=pullCall_V9_Reverse_21.Element, item21=pullCall_V9_Reverse_22.Element, item22=pullCall_V9_Reverse_23.Element, item23=pullCall_V9_Reverse_24.Element, item24=pullCall_V9_Reverse_25.Element, item25=pullCall_V9_Reverse_26.Element, item26=pullCall_V9_Reverse_27.Element, item27=pullCall_V9_Reverse_28.Element, item28=pullCall_V9_Reverse_29.Element, item29=pullCall_V9_Reverse_30.Element, item30=pullCall_V9_Reverse_31.Element, item31=pullCall_V9_Reverse_32.Element, item32=pullCall_V9_Reverse_33.Element, item33=pullCall_V9_Reverse_34.Element, item34=pullCall_V9_Reverse_35.Element, item35=pullCall_V9_Reverse_36.Element)

# group: Outputs
reverse_T2_N_Value = List.Create(item0=pullCall_V9_Reverse.Reverse_T2_N, item1=pullCall_V9_Reverse_2.Reverse_T2_N, item2=pullCall_V9_Reverse_3.Reverse_T2_N, item3=pullCall_V9_Reverse_4.Reverse_T2_N, item4=pullCall_V9_Reverse_5.Reverse_T2_N, item5=pullCall_V9_Reverse_6.Reverse_T2_N, item6=pullCall_V9_Reverse_7.Reverse_T2_N, item7=pullCall_V9_Reverse_8.Reverse_T2_N, item8=pullCall_V9_Reverse_9.Reverse_T2_N, item9=pullCall_V9_Reverse_10.Reverse_T2_N, item10=pullCall_V9_Reverse_11.Reverse_T2_N, item11=pullCall_V9_Reverse_12.Reverse_T2_N, item12=pullCall_V9_Reverse_13.Reverse_T2_N, item13=pullCall_V9_Reverse_14.Reverse_T2_N, item14=pullCall_V9_Reverse_15.Reverse_T2_N, item15=pullCall_V9_Reverse_16.Reverse_T2_N, item16=pullCall_V9_Reverse_17.Reverse_T2_N, item17=pullCall_V9_Reverse_18.Reverse_T2_N, item18=pullCall_V9_Reverse_19.Reverse_T2_N, item19=pullCall_V9_Reverse_20.Reverse_T2_N, item20=pullCall_V9_Reverse_21.Reverse_T2_N, item21=pullCall_V9_Reverse_22.Reverse_T2_N, item22=pullCall_V9_Reverse_23.Reverse_T2_N, item23=pullCall_V9_Reverse_24.Reverse_T2_N, item24=pullCall_V9_Reverse_25.Reverse_T2_N, item25=pullCall_V9_Reverse_26.Reverse_T2_N, item26=pullCall_V9_Reverse_27.Reverse_T2_N, item27=pullCall_V9_Reverse_28.Reverse_T2_N, item28=pullCall_V9_Reverse_29.Reverse_T2_N, item29=pullCall_V9_Reverse_30.Reverse_T2_N, item30=pullCall_V9_Reverse_31.Reverse_T2_N, item31=pullCall_V9_Reverse_32.Reverse_T2_N, item32=pullCall_V9_Reverse_33.Reverse_T2_N, item33=pullCall_V9_Reverse_34.Reverse_T2_N, item34=pullCall_V9_Reverse_35.Reverse_T2_N, item35=pullCall_V9_Reverse_36.Reverse_T2_N)

# group: To Revit
clean_element_2 = List.Clean(list=element_2)
code_block_38 = CodeBlock(val=reverse_T2_N_Value) { val == 0 ? null : val; }
clean_Value_2 = List.Clean(list=code_block_38)

math_round_n_m = Math.Round(number=clean_Value_2)
G = CodeBlock(G=gravity_9_8_n_kg) { G; }

# group: Reverse_T2_kg/N
code_block_39 = CodeBlock { "Reverse_T2_kg"; "Reverse_T2(n)"; }
setParameterByName_12 = Element.SetParameterByName(element=clean_element_2, parameterName=code_block_39.out1, value=math_round_n_m)
# note: If you see “null” or “NAN”
# Cause you pick Slope up or Slope down, but it actual a straight
# Solution
# Check Section Type of DUCT
kg_9_8 = CodeBlock(a=clean_Value_2, g=G) { a/g; }
round_2 = Math.Round(number=kg_9_8)
kg_9_8_2 = Element.SetParameterByName(element=clean_element_2, parameterName=code_block_39.out0, value=round_2)

t2_kg_9_8 = CodeBlock(A=N, G=G) { A/G; }
T2_kg = Math.Round(number=t2_kg_9_8)
t_f_kg = Element.SetParameterByName(element=clean_element, parameterName=code_block_25.out0, value=T2_kg)

# group: Allowable Tension/Sidewall(n)
allowable_tension_n_3 = CodeBlock { "Allowable Tension(n)"; }
allowable_sidewall_n_m_3 = CodeBlock { "Allowable Sidewall (N-m)"; }

# group: sidewall pressure
sidewall_pressure_n_m = List.Create(item0=pullCal_V9.SidewallPressure_N, item1=pullCal_V9_2.SidewallPressure_N, item2=pullCal_V9_3.SidewallPressure_N, item3=pullCal_V9_4.SidewallPressure_N, item4=pullCal_V9_5.SidewallPressure_N, item5=pullCal_V9_6.SidewallPressure_N, item6=pullCal_V9_7.SidewallPressure_N, item7=pullCal_V9_8.SidewallPressure_N, item8=pullCal_V9_9.SidewallPressure_N, item9=pullCal_V9_10.SidewallPressure_N, item10=pullCal_V9_11.SidewallPressure_N, item11=pullCal_V9_12.SidewallPressure_N, item12=pullCal_V9_13.SidewallPressure_N, item13=pullCal_V9_14.SidewallPressure_N, item14=pullCal_V9_15.SidewallPressure_N, item15=pullCal_V9_16.SidewallPressure_N, item16=pullCal_V9_17.SidewallPressure_N, item17=pullCal_V9_18.SidewallPressure_N, item18=pullCal_V9_19.SidewallPressure_N, item19=pullCal_V9_20.SidewallPressure_N, item20=pullCal_V9_21.SidewallPressure_N, item21=pullCal_V9_22.SidewallPressure_N, item22=pullCal_V9_23.SidewallPressure_N, item23=pullCal_V9_24.SidewallPressure_N, item24=pullCal_V9_25.SidewallPressure_N, item25=pullCal_V9_26.SidewallPressure_N, item26=pullCal_V9_27.SidewallPressure_N, item27=pullCal_V9_28.SidewallPressure_N, item28=pullCal_V9_29.SidewallPressure_N, item29=pullCal_V9_30.SidewallPressure_N, item30=pullCal_V9_31.SidewallPressure_N, item31=pullCal_V9_32.SidewallPressure_N, item32=pullCal_V9_33.SidewallPressure_N, item33=pullCal_V9_34.SidewallPressure_N, item34=pullCal_V9_35.SidewallPressure_N, item35=pullCal_V9_36.SidewallPressure_N)

# group: Review
code_block_40 = CodeBlock(val=sidewall_pressure_n_m) { val == 0 ? null : val; }
clean_Value_3 = List.Clean(list=code_block_40)
code_block_41 = CodeBlock(val=clean_Value_3) { val == null ? 0 : val; }
replace = CodeBlock(val=code_block_41) { val == "∞" ? "0" : val; }
toNumber = String.ToNumber(string=replace)
n_mm = Math.Round(number=toNumber)

# group: SWBP_
code_block_42 = CodeBlock { "SWBP_(kg-m)"; "SWBP_(N-m)"; }
# note: If you see “null” or “NAN”
# Cause you pick Slope up or Slope down, but it actual a straight
# Solution
# Check Section Type of DUCT
fs_n_m = Element.SetParameterByName(element=clean_element, parameterName=code_block_42.out1, value=n_mm)
swbp__k_g_9_8 = CodeBlock(A=toNumber, G=G) { A/G; }
fs_kg_m = Math.Round(number=swbp__k_g_9_8)
fs_kg_m_2 = Element.SetParameterByName(element=clean_element, parameterName=code_block_42.out0, value=fs_kg_m)

# group: sidewall pressure
sidewall_pressure_kg = List.Create(item0=pullCall_V9_Reverse.P, item1=pullCall_V9_Reverse_2.P, item2=pullCall_V9_Reverse_3.P, item3=pullCall_V9_Reverse_4.P, item4=pullCall_V9_Reverse_5.P, item5=pullCall_V9_Reverse_6.P, item6=pullCall_V9_Reverse_7.P, item7=pullCall_V9_Reverse_8.P, item8=pullCall_V9_Reverse_9.P, item9=pullCall_V9_Reverse_10.P, item10=pullCall_V9_Reverse_11.P, item11=pullCall_V9_Reverse_12.P, item12=pullCall_V9_Reverse_13.P, item13=pullCall_V9_Reverse_14.P, item14=pullCall_V9_Reverse_15.P, item15=pullCall_V9_Reverse_16.P, item16=pullCall_V9_Reverse_17.P, item17=pullCall_V9_Reverse_18.P, item18=pullCall_V9_Reverse_19.P, item19=pullCall_V9_Reverse_20.P, item20=pullCall_V9_Reverse_21.P, item21=pullCall_V9_Reverse_22.P, item22=pullCall_V9_Reverse_23.P, item23=pullCall_V9_Reverse_24.P, item24=pullCall_V9_Reverse_25.P, item25=pullCall_V9_Reverse_26.P, item26=pullCall_V9_Reverse_27.P, item27=pullCall_V9_Reverse_28.P, item28=pullCall_V9_Reverse_29.P, item29=pullCall_V9_Reverse_30.P, item30=pullCall_V9_Reverse_31.P, item31=pullCall_V9_Reverse_32.P, item32=pullCall_V9_Reverse_33.P, item33=pullCall_V9_Reverse_34.P, item34=pullCall_V9_Reverse_35.P, item35=pullCall_V9_Reverse_36.P)

# group: Review
code_block_43 = CodeBlock(val=sidewall_pressure_kg) { val == 0 ? null : val; }
clean_Value_4 = List.Clean(list=code_block_43)
code_block_44 = CodeBlock(val=clean_Value_4) { val == null ? 0 : val; }
replace_2 = CodeBlock(val=code_block_44) { val == "∞" ? "0" : val; }
toNumber_2 = String.ToNumber(string=replace_2)
round_3 = Math.Round(number=toNumber_2)

# group: Reverse_SWBP_
code_block_45 = CodeBlock { "Reverse_SWBP_(kg-m)"; "Reverse_SWBP_(N-m)"; }
setParameterByName_13 = Element.SetParameterByName(element=clean_element_2, parameterName=code_block_45.out1, value=round_3)
# note: If you see “null” or “NAN”
# Cause you pick Slope up or Slope down, but it actual a straight
# Solution
# Check Section Type of DUCT
SWBP = CodeBlock(A=toNumber_2, G=G) { A/G; }
round_4 = Math.Round(number=SWBP)
setParameterByName_14 = Element.SetParameterByName(element=clean_element_2, parameterName=code_block_45.out0, value=round_4)

# group: Result
result_forward = CodeBlock { "Result(Forward)"; }
result_reverse = CodeBlock { "Result(Reverse)"; }

# group: Newton
code_block_46 = CodeBlock { 1; }
result_forward_t = CodeBlock(AllowableSidewallNm=allowable_sidewall_n_m_2, TFnm=n_mm, Results=code_block_46) { AllowableSidewallNm>=TFnm?Results:0; }
result_forward_side_n_m = CodeBlock(AllowableTensionnN=allowable_tension_n_2, Fs=N, Results=code_block_46) { AllowableTensionnN>=Fs?Results:0; }
code_block_47 = CodeBlock(a=result_forward_t, b=result_forward_side_n_m) { a+b; }
code_block_48 = CodeBlock { "Pass"; }
result_forward_2 = CodeBlock(Forward=code_block_47, Results=code_block_48) { Forward==2?Results:"Fail"; }
result_forward_3 = Element.SetParameterByName(element=clean_element, parameterName=result_forward, value=result_forward_2)

# group: Newton-Reverse
code_block_49 = CodeBlock { 1; }
result_reverse_t_n = CodeBlock(AllowableSidewallNm=allowable_sidewall_n_m_2, TSnm=round_3, Results=code_block_49) { AllowableSidewallNm>=TSnm?Results:0; }
result_reverse_side_n_m = CodeBlock(AllowableTensionnN=allowable_tension_n_2, Ts=math_round_n_m, Results=code_block_49) { AllowableTensionnN>=Ts?Results:0; }
code_block_50 = CodeBlock(a=result_reverse_t_n, b=result_reverse_side_n_m) { a+b; }
code_block_51 = CodeBlock { "Pass"; }
result_reverse_2 = CodeBlock(Reverse1=code_block_50, Results=code_block_51) { Reverse1==2?Results:"Fail"; }
result_reverse_3 = Element.SetParameterByName(element=clean_element_2, parameterName=result_reverse, value=result_reverse_2)

# group: convert kg
allowable_tension_kg = CodeBlock { "Allowable_Tension(Kg)"; }
allowable_sidewall_kg_m = CodeBlock { "Allowable_Sidewall(kg-m)"; }
code_block_52 = CodeBlock { "Cable_Arrangement"; }

# group: Duct Configuration
d_d_2 = CodeBlock(d=d_cable_od_mm, D=d_duct_id_mm) { DSCore.Math.Pow(d,2); DSCore.Math.Pow(D,2); }
dmm2 = CodeBlock(d=d_d_2.out0) { (3.14159*(d))/4; }
# note: Allowable Percentage of conductor fill
# 40%
dmm2_2 = CodeBlock(D=d_d_2.out1) { (3.14159*(D))/4; }
percentage_of_conductor_fill = CodeBlock(d=dmm2, Cn=number_of_cable, D=dmm2_2) { ((d*Cn)/D)*100; }

# group: Review
get_list = CodeBlock(a=code_block_14, b=code_block_14) { (a/b)*0; }
f_2 = CodeBlock(a=f_or_f, b=get_list) { a+b; }
add_value = CodeBlock(a=cable_number_weight, b=get_list) { a+b; }
mm_to_m = CodeBlock(mmtm=r_blank_too_0) { mmtm/1000; }
add_value_2 = CodeBlock(a=allowable_tension_n_2, b=get_list) { a+b; }
add_value_3 = CodeBlock(a=number_of_cable, b=get_list) { a+b; }
add_value_4 = CodeBlock(a=d_cable_mm, b=get_list) { a+b; }
add_value_5 = CodeBlock(a=d_conduit_inside_mm, b=get_list) { a+b; }
allowable_sidewall_n_m_4 = CodeBlock(a=allowable_sidewall_n_m, b=get_list) { a+b; }
add_value_6 = CodeBlock(a=wc, b=get_list) { a+b; }
side_wall_force_kg = CodeBlock(a=allowable_tension_n) { a/9.8; }
allowable_tension_kg_2 = CodeBlock(a=side_wall_force_kg, b=get_list) { a+b; }
round_5 = Math.Round(number=allowable_tension_kg_2)
allowable_side_wall_force_kg_m = CodeBlock(a=allowable_sidewall_n_m) { a/9.8; }
allowable_sidewall_kg_m_2 = CodeBlock(a=allowable_side_wall_force_kg_m, b=get_list) { a+b; }
round_6 = Math.Round(number=allowable_sidewall_kg_m_2)
allowable_sidewall_kg_m_3 = CodeBlock(a=percentage_of_conductor_fill, b=get_list) { a+b; }
round_7 = Math.Round(number=allowable_sidewall_kg_m_3)
cable_Arrangement_2 = CodeBlock(b=get_list) { b; }
cable_Arrangement_3 = CodeBlock(b=cable_Arrangement_2, Results=cable_Arrangement) { b==0?Results:""; }
cable_Reference_2 = CodeBlock(b=cable_Arrangement_2, Results=cable_reference) { b==0?Results:""; }
weight_Per_Cable_2 = CodeBlock(a=w_weight_per_cable_kg_m, b=get_list) { a+b; }

# group: Round
code_block_53 = CodeBlock { 5; }
round_8 = Math.Round(number=f_2, digits=code_block_53)

# group: Friction(f)
setParameterByName_15 = Element.SetParameterByName(element=watch_2, parameterName=friction, value=round_8)

# group: Weight(w)
setParameterByName_16 = Element.SetParameterByName(element=watch_2, parameterName=weight, value=add_value)

# group: "Duct Radius(M)";
setParameterByName_17 = Element.SetParameterByName(element=watch_2, parameterName=code_block_33, value=mm_to_m)

# group: Allowable Tension(n)
setParameterByName_18 = Element.SetParameterByName(element=watch_2, parameterName=allowable_tension_n_3, value=add_value_2)

# group: Cables in Duct
setParameterByName_19 = Element.SetParameterByName(element=watch_2, parameterName=d_d_number.out2, value=add_value_3)

# group: Cable Outside(mm)
setParameterByName_20 = Element.SetParameterByName(element=watch_2, parameterName=d_d_number.out1, value=add_value_4)

# group: Conduit Inside(mm)
setParameterByName_21 = Element.SetParameterByName(element=watch_2, parameterName=d_d_number.out0, value=add_value_5)

# group: Allowable Sidewall (N-m)
setParameterByName_22 = Element.SetParameterByName(element=watch_2, parameterName=allowable_sidewall_n_m_3, value=allowable_sidewall_n_m_4)

# group: Review > Round
code_block_54 = CodeBlock { 4; }
round_9 = Math.Round(number=add_value_6, digits=code_block_54)

# group: Weight Correction(Wc)
setParameterByName_23 = Element.SetParameterByName(element=watch_2, parameterName=weight_correction_wc, value=round_9)

# group: Side Wall Force(Kg)
setParameterByName_24 = Element.SetParameterByName(element=watch_2, parameterName=allowable_tension_kg, value=round_5)

# group: Allowable_Sidewall(kg-m)
setParameterByName_25 = Element.SetParameterByName(element=watch_2, parameterName=allowable_sidewall_kg_m, value=round_6)

# group: %_of_Conductor_Fill
setParameterByName_26 = Element.SetParameterByName(element=watch_2, parameterName=of_conductor_fill, value=round_7)

# group: 4.7 Weight correction factor - IEEEE standard (Wc) Up to a D/d ratio of 2.5, cables are constrained into a triangular configuration. Wc for this arrangement may be calculated using Equation (7b). > IF Statments Allwats assume triangular configuration- Dont usr 2.5-3 or 3
under_2_5 = CodeBlock(Ratio=code_block_24, Results1=wc_up_to_a_d_d_ratio_of_2_5) { Ratio==1?Results1:0; }
between_2_5_3 = CodeBlock(Ratio=code_block_24, Results2=d_d_ratio_between_2_5_and_3_0_1) { Ratio==2?Results2:0; }
over_3_2 = CodeBlock(Ratio=code_block_24, Results3=d_d_ratios_above_3_0_1_4_3_d_d_d) { Ratio==3?Results3:0; }

# group (continued): 4.7 Weight correction factor - IEEEE standard (Wc) Up to a D/d ratio of 2.5, cables are constrained into a triangular configuration. Wc for this arrangement may be calculated using Equation (7b).
wc_if_not_assume = CodeBlock(A1=under_2_5, B2=between_2_5_3, C3=over_3_2) { A1+B2+C3; }

# group: Cable_Arrangement
setParameterByName_27 = Element.SetParameterByName(element=watch_2, parameterName=code_block_52, value=cable_Arrangement_3)

# group: Cable_Reference
setParameterByName_28 = Element.SetParameterByName(element=watch_2, parameterName=cable_Reference, value=cable_Reference_2)

# group: Weight per cable
setParameterByName_29 = Element.SetParameterByName(element=watch_2, parameterName=weight_Per_Cable, value=weight_Per_Cable_2)
